# Grasshopper definition parametric.gh (Grasshopper 1.0.7)

# ---- group: _ARCHIVED / 1D / Poly Input 2 Cmds
curve = Curve(<curve referenced from the Rhino model>)
poly_input_2cmds = GhPythonScript(x=curve)  # -> out, a, b; disabled
# ---------- poly_input_2cmds: Python ----------
__author__ = "angelz"

import rhinoscriptsyntax as rs
import Rhino.Geometry as rg
import math
 

def move_polyline_to_origin(polyline):
    # Ensure the input is a polyline
    if not isinstance(polyline, rg.Polyline):
        print(polyline)
        raise ValueError("Input must be a Polyline.")
    
    # Define the start point of the polyline
    start_point = polyline[0]
    
    # Define the world origin point
    origin = rg.Point3d(0,0,0)
    
    # Create a vector from the start point to the origin
    move_vector = rg.Vector3d(origin - start_point)
    
    translation = rg.Transform.Translation(move_vector)

    
    # Move the polyline along this vector
    moved_polyline = polyline.Duplicate()
    moved_polyline.Transform(translation)
    
    return moved_polyline

def rotate_polyline_to_align_with_z(polyline):
    # Ensure the input is a polyline
    if not isinstance(polyline, rg.Polyline):
        raise ValueError("Input must be a Polyline.")
    
    # Calculate the direction vector of the first segment
    start_point = polyline[0]
    end_point = polyline[1]
    segment_vector = end_point - start_point
    
    # The target vector (positive Z-axis)
    z_vector = rg.Vector3d(0, 0, 1)
    
    # Calculate the rotation axis (cross product of segment_vector and z_vector)
    rotation_axis = rg.Vector3d.CrossProduct(segment_vector, z_vector)
    
    # If the segment is already aligned with the Z-axis, rotation is not needed
    if rotation_axis.IsZero:
        return polyline
    
    # Calculate the angle between the segment_vector and the z_vector
    angle = rg.Vector3d.VectorAngle(segment_vector, z_vector)
    
    # Create a rotation transform
    # The point of rotation is the start point of the polyline
    rotation = rg.Transform.Rotation(angle, rotation_axis, start_point)
    
    # Apply the rotation to a duplicate of the polyline
    rotated_polyline = polyline.Duplicate()
    rotated_polyline.Transform(rotation)
    
    return rotated_polyline


def get_segment_lengths(polyline):
    # Check if the input is a polyline
    if not isinstance(polyline, rg.Polyline):
        raise ValueError("Input must be a Polyline.")
    
    # Initialize a list to store lengths
    lengths = []
    
    # Loop through each segment in the polyline
    for i in range(len(polyline) - 1):
        # Calculate the length of the segment
        segment_length = polyline[i].DistanceTo(polyline[i + 1])
        lengths.append(segment_length)
    
    return lengths
    
def calculate_angles_between_segments(polyline):
    angles = [0]
    # Check if the input is a polyline and has at least 3 points (for at least 2 segments)
    if not isinstance(polyline, rg.Polyline) or len(polyline) < 3:
        raise ValueError("Input must be a Polyline with at least 3 points.")
    
    # Iterate through the segments of the polyline to calculate angles
    for i in range(1, len(polyline) - 1):
        # Calculate vectors for consecutive segments
        vector_a = polyline[i] - polyline[i-1]
        vector_b = polyline[i+1] - polyline[i]
        
        # Normalize vectors to avoid influence of segment length on angle
        vector_a.Unitize()
        vector_b.Unitize()
        
        # Calculate angle between vectors in radians
        angle_radians = rg.Vector3d.VectorAngle(vector_a, vector_b)
        
        # Convert angle to degrees (optional)
        angle_degrees = math.degrees(angle_radians)
        
        # Add angle to the list
        angles.append(angle_degrees)
    
    print(angles)
    return angles

def scale_polyline_to_length(polyline, target_length=3.6*80):
    # Check if the input is a polyline
    if not isinstance(polyline, rg.Polyline):
        raise ValueError("Input must be a Polyline.")
    
    # Calculate the current total length of the polyline
    current_length = 0
    for i in range(1, len(polyline)):
        current_length += polyline[i-1].DistanceTo(polyline[i])
    
    if current_length == 0:
        raise ValueError("The polyline's length is zero or it has insufficient points.")
    
    # Calculate the scale factor
    scale_factor = target_length / current_length
    
    # Determine a base point for scaling, e.g., the first point of the polyline
    base_point = polyline[0]
    
    # Create a uniform scale transform
    scale_transform = rg.Transform.Scale(base_point, scale_factor)
    
    # Create a copy of the polyline to apply the transformation
    scaled_polyline = polyline.Duplicate()
    scaled_polyline.Transform(scale_transform)
    
    return scaled_polyline
    
def divide_polyline_fixed_length(polyline, segment_length=3.6):
    # Check if the input is a polyline
    if not isinstance(polyline, rg.Polyline):
        raise ValueError("Input must be a Polyline.")
    
    # Initialize a list to store the points of the new segments
    new_points = [polyline[0]]  # Start with the first point of the original polyline
    commands = []
    
    # Iterate over each segment in the original polyline
    for i in range(1, len(polyline)):
        current_point = polyline[i-1]
        next_point = polyline[i]
        
        # Calculate the vector and length of the current segment
        segment_vector = next_point - current_point
        segment_length_current = float(segment_vector.Length)
        segment_vector.Unitize()  # Normalize the segment vector
        
        segment_length_current_rounded = round(segment_length_current, 2)

        
        # print(segment_length_current)
        
        if segment_length_current_rounded <= 2.48:
            new_points.append(next_point)  # Add the next point without dividing
            commands.append(2)
            # print("appending 2")
            continue
        
        total_length_covered = 0.0
        while total_length_covered + segment_length <= segment_length_current:
            # Calculate the next point based on the segment length
            total_length_covered += segment_length
            new_point = current_point + segment_vector * total_length_covered
            new_points.append(new_point)
            
            commands.append(1) # 3.6mm segments
        
        # Handle the remaining length in the segment
        remaining_length = segment_length_current - total_length_covered
        if remaining_length > 0:
            if abs(segment_length-remaining_length)<0.1:    
                total_length_covered += segment_length  # Adjust total length covered as if a 3.6 segment was added
                new_point = current_point + segment_vector * total_length_covered
                new_points.append(new_point)
                
                commands.append(1) # 3.6mm segments
                
            # If remaining length is smaller than 3.6, divide into 0.1-length sub-segments
            elif 0.5 <= remaining_length <= 3.5:
                # Calculate the number of sub-segments and the adjusted sub-segment length
                num_subsegments = int(round(remaining_length / 1))
                adjusted_subsegment_length = round(remaining_length /num_subsegments, 1)
                
                for _ in range(1, num_subsegments):
                    total_length_covered += adjusted_subsegment_length
                    new_point = current_point + segment_vector * total_length_covered
                    new_points.append(new_point)
                    
                    commands.append(0) # 0.1 segments
        
        # Add the end point of the segment if not already included
        if new_points[-1] != next_point:
            new_points.append(next_point)
    
    # Create a new polyline from the calculated points
    new_polyline = rg.Polyline(new_points)
    
    return (new_polyline, commands)
    
def map_angle_to_target(angle):
    """Maps an angle to the nearest target angle (0, 20, 40, 60, 80)."""
    target_angles = [0, 20, 40, 60, 80]
    if angle > 80:
        return 80
    else:
        return min(target_angles, key=lambda x: abs(x-angle))

def round_angles(angles):
    # return [map_angle_to_target(i) for i in angles]
    return [min(360,round(a/20)*20) for a in angles]

def construct_polyline(segment_lengths, angles_between_segments,start_point=rg.Point3d(40,0,0)):
    num_segments = len(segment_lengths)
    
    # Ensure the angles list matches the number of segments - 1
    if len(angles_between_segments) != num_segments:
        raise ValueError("The length of angles_between_segments must be num_segments - 1.")
    
    points = [start_point]
    current_direction = rg.Vector3d(0, 0, 1)  # Starting direction along World Z positive
    
    for i in range(num_segments):
        
        angle = angles_between_segments[i]
        segment_length = segment_lengths[i]
        
        # Rotate the direction vector around the Y-axis by the given angle
        # Note: Rhino.Geometry uses radians, so convert degrees to radians
        angle_radians = math.radians(angle)
        rotation = rg.Transform.Rotation(angle_radians, rg.Vector3d.YAxis, points[-1])
        current_direction.Transform(rotation)
        
        # Calculate the end point of the next segment
        next_point = rg.Point3d.Add(points[-1], current_direction * segment_length)
        points.append(next_point)
    
    # Create the polyline from the calculated points
    polyline = rg.Polyline(points)
    
    return polyline
    
def divide_angles(segment_lengths, angles_between_segments):
    cos20 = math.cos(math.radians(20))
    
    num_segments = len(segment_lengths)
    
    new_lengths = []
    new_angles = []
    
    for i in range(num_segments):
        
        prev_angle = angles_between_segments[i]            
        next_angle = angles_between_segments[i+1] if (i!=num_segments-1) else 0

        cur_seg = segment_lengths[i]
        
        if next_angle > 20:
            a_num = int(next_angle / 20)  # Calculate how many 3mm segments needed for the angle change
            cur_seg -= (math.floor(1+a_num/2) * cos20 * 2.48)
        
        if prev_angle == 0:
            new_angles.append(prev_angle)
            new_lengths.append(cur_seg)
        else:
            a_num = int(prev_angle / 20)  # Calculate how many 3mm segments needed for the angle change
            cur_seg -= (math.floor(a_num/2) * cos20 * 2.48)            
            for i in range(a_num):   # start from 40
                    
                new_lengths.append(2.48)
                new_angles.append(20)
                
                if ((i+1) % 4) == 0: 
                    new_lengths.append(3.6)
                    new_angles.append(0)
                    cur_seg -= cos20 * 3.6

            new_lengths.append(cur_seg)
            new_angles.append(0.0)

    return (new_lengths, new_angles)

    
def divide_segments_fixed_length_with_angles(segments, angles, base_length=3.6):
    # Initialize empty lists to store the new segment lengths and their corresponding angles
    new_segments = []
    new_angles = []
    
    # Ensure the segments and angles arrays have the same length
    if len(segments) != len(angles):
        raise ValueError("Segments and angles arrays must have the same length.")
    
    for i, segment_length in enumerate(segments):
        if segment_length <= 2.48:
            new_segments.append(segment_length)
            new_angles.append(angles[i])
            continue
            
        segment_length = 3.6 * round (segment_length / 3.6)
        
        # Calculate the number of full base_length segments that can fit into the current segment
        num_full_segments = int(segment_length // base_length)
        
        # Calculate the remaining length after fitting the full base_length segments
        remaining_length = segment_length % base_length
        
        # Adjust based on the threshold of 0.5
        if remaining_length >= 0.5:
            # If remaining length is closer to a full base_length segment, add one more base_length segment
            if base_length - remaining_length <= 0.5:
                num_full_segments += 1
                remaining_length = 0  # Reset remaining length as it's considered part of a new full segment
            else:
                # Remaining length is treated as separate 1-length segments
                remaining_length = round(remaining_length)  # Round remaining length to the nearest whole number
        
        # For the first segment, use the original angle, for subsequent subdivisions, use 0
        if num_full_segments > 0:
            new_segments.extend([base_length] * num_full_segments)
            new_angles.append(angles[i])  # Original angle for the first piece
            new_angles.extend([0] * (num_full_segments - 1))  # 0 for subsequent pieces
        
        # Add remaining lengths as 1-length segments, if any
        if remaining_length > 0:
            num_one_length_segments = int(remaining_length)
            new_segments.extend([1] * num_one_length_segments)  # Add as many 1-length segments as the remaining length
            # For 1-length segments, only the first segment should have the original angle if no base_length segments were added
            if num_full_segments == 0:
                new_angles.append(angles[i])  # Original angle for the first piece if no base_length segments were added
                if num_one_length_segments > 1:
                    new_angles.extend([0] * (num_one_length_segments - 1))  # 0 for subsequent pieces
            else:
                new_angles.extend([0] * num_one_length_segments)  # 0 for all 1-length segments if base_length segments were added
    
    return new_segments, new_angles

def seg2cmd(seg):
    if seg == 2.48:
        return 2
    elif seg == 3.6:
        return 1
    elif seg == 1:
        return 0
    else:
        raise ValueError("invalid input")
    
p = rs.coercecurve(x).ToPolyline()
p = move_polyline_to_origin(p)
p = rotate_polyline_to_align_with_z(p)

p = scale_polyline_to_length(p) # default total length 3.6*80

lengths = get_segment_lengths(p)
print(lengths)
angles = calculate_angles_between_segments(p)
angles = round_angles(angles)

print(angles)
lengths, angles = divide_angles(lengths, angles)

print(lengths)
print(angles)

p = construct_polyline(lengths, angles)

# p, commands = divide_polyline_fixed_length(p)

segs, angles = divide_segments_fixed_length_with_angles(lengths, angles)

print("\nseg and angles")

print(",".join("%.2f" % number for number in segs))
print(angles)
    
p = construct_polyline(segs, angles)

commands = [seg2cmd(s) for s in segs]

cmd_str = ",".join("%i"%c for c in commands)

print(cmd_str)

a = p

b = cmd_str
# ---------- end poly_input_2cmds ----------
polyline = PolyLine(Vertices=poly_input_2cmds.a, Closed=False)
panel = Panel(poly_input_2cmds.b)

# ---- group: _ARCHIVED / 1D / Commands 2 Visual
panel_2 = Panel("1,1,1,1,3,3,3,2,1")
cmds2polyvis = GhPythonScript(x=panel)  # -> out, a
# ---------- cmds2polyvis: Python ----------
__author__ = "angelz"

import rhinoscriptsyntax as rs
import Rhino.Geometry as rg
import math
import random



def FunctionA(plane, offset):
    # print("function A called")
    r = offsetPlane(plane, offset)
    return r
    
def FunctionB(plane, angle):
    # print("function A called")
    r = offsetPlane(plane, 0.5)
    r = rotatePlane(r, angle)
    r = offsetPlane(r, 2)
    return r

def offsetPlane(plane, offset_distance):
            
    # Get the normal vector of the input plane
    normal_vector = plane.Normal
    
    # Scale the normal vector by the offset distance
    offset_vector = normal_vector * offset_distance
    
    # Create a new plane by translating the original plane along the offset vector
    offset_origin = plane.Origin + offset_vector
    offset_plane = rg.Plane(offset_origin, plane.XAxis, plane.YAxis)
    
    return offset_plane
    
def rotatePlane(input_plane, angle_degrees):

    # Convert rotation angle to radians
    angle_radians = math.radians(angle_degrees)

    # Create a rotation transformation around the plane's origin
    rotation = rg.Transform.Rotation(angle_radians, input_plane.YAxis, input_plane.Origin)
    ###### To change direction, change the rotation axis
    
    rotated_y_axis = input_plane.YAxis
    rotated_y_axis.Transform(rotation)

    rotated_x_axis = input_plane.XAxis
    rotated_x_axis.Transform(rotation)
    
    rotated_plane = rg.Plane(input_plane.Origin, rotated_x_axis, rotated_y_axis)

    # Output the rotated plane
    return rotated_plane
    
def GeneratePlanes(sequence):
    planes = []
    planes.append(rg.Plane.WorldXY)
    
    for i, item in enumerate(sequence):

        
        plane = planes[-1]
            
        if item == 0:
            new_plane = FunctionA(plane, 1)
        elif item == 1:
            new_plane = FunctionA(plane, 3.6)
        elif item == 2:
            new_plane = FunctionB(plane, 20)
        elif item == 3:
            new_plane = FunctionB(plane, -20)
        
        planes.append(new_plane)
    
    return planes
    

def parseInput(x):
    sequence = []
    if isinstance(x, str):
    # Split the string by commas and convert each element to an integer
        sequence = [int(i) for i in x.split(',')]
    # Ensure the sequence list contains only 0s and 1s
    valid_sequence = all(item == 0 or item == 1 or item == 2 or item == 3 for item in sequence)
    if valid_sequence:
        print("Valid Input")
        print(sequence)
    else:
        # Handle invalid input
        print("Invalid input. Please provide a sequence of 0s,1s,2s,3s")
        print("Generating random sequence for testing.")
        # sequence = [1,1,1,2,2,2,2,2,3,3,3,3,3,1,1,1,1,1,1,3,3,3,3,3]
        sequence = [random.randint(0, 3) for _ in range(40)]
        
    return sequence
    

def segment_lengths(polyline):
    # Check if the input is a polyline
    if not isinstance(polyline, rg.Polyline):
        raise ValueError("Input must be a Polyline.")
    
    # Initialize a list to store lengths
    lengths = []
    
    # Loop through each segment in the polyline
    for i in range(len(polyline) - 1):
        # Calculate the length of the segment
        segment_length = polyline[i].DistanceTo(polyline[i + 1])
        lengths.append(segment_length)
    
    return lengths
    
sequence = parseInput(x)
print(x)

group = GeneratePlanes(sequence)

# Create a Group to store all the planes


all_origins = [plane.Origin for plane in group]
p = rg.Polyline(all_origins)

a = p

print(a)
# ---------- end cmds2polyvis ----------
polyline_2 = PolyLine(Vertices=cmds2polyvis.a, Closed=False)

# ---- group: _ARCHIVED / to motor commands
_2motor_cmds = GhPythonScript(x=panel)  # -> out, a; disabled
# ---------- _2motor_cmds: Python ----------
__author__ = "angelz"

import rhinoscriptsyntax as rs

import json


def parseInput(x):
    sequence = []
    if isinstance(x, str):
    # Split the string by commas and convert each element to an integer
        sequence = [int(i) for i in x.split(',')]
    # Ensure the sequence list contains only 0s and 1s
    valid_sequence = all(item == 0 or item == 1 or item == 2 or item == 3 for item in sequence)
    if valid_sequence:
        print("Valid Input")
        print(sequence)
    else:
        # Handle invalid input
        print("Invalid input. Please provide a sequence of 0s,1s,2s,3s")
        print("Generating random sequence for testing.")
        # sequence = [1,1,1,2,2,2,2,2,3,3,3,3,3,1,1,1,1,1,1,3,3,3,3,3]
        sequence = [random.randint(0, 3) for _ in range(40)]
        
    return sequence
    
def parseArray(seq):
    arr1=[]
    arr2=[]
    
    i_l = 0
    prev = seq[i_l]
    print(len(seq))
    
    for i,item in enumerate(seq):
        # print(item)
        if item != prev:
            # print("item not equal to prev")
            arr2.append(prev)
            arr1.append(i-i_l)
            i_l = i
            prev = item
        if i == len(seq)-1:
            arr2.append(prev)
            arr1.append(i-i_l+1)
            
    
    arr3 = [parseAngle(e) for e in arr2]
    arr4 = [parseType(e) for e in arr2]
    
    print(sum(arr1))
    
    return (arr1,arr4,arr3)
    
def parseType(i):
    if (i==0):
        return 's'
    elif i==1:
        return 'e'
    elif i==2 or i==3:
        return 'f'
    else:
        return ''

def parseAngle(i):
    if i==0 or i==1:
        return 0
    elif i == 2:
        return 90
    elif i == 3:
        return 270
    else:
        return 0

    
seq = parseInput(x)

tmp = parseArray(seq)
print(tmp[0])
print(tmp[1])
print(tmp[2])


# Data to be saved to JSON
data = {
    "values": tmp[0],
    "commands": tmp[1],
}

print(data)

# Define the file path where you want to save the JSON file
file_name = 'gh_commands.json'
file_path = '/Users/angelz/Desktop/'+file_name

# Open the file in write mode and save the data as JSON
with open(file_path, 'w') as json_file:
    json.dump(data, json_file, indent=4)

print("Data saved to JSON file:", file_path)


a = tmp
# ---------- end _2motor_cmds ----------

# ---- group: _ARCHIVED / 3D angle - constructed vec
gh_vec_projection = GhPythonScript()  # -> out, x, y, p, d, a, b; disabled
# ---------- gh_vec_projection: Python ----------
__author__ = "angelz"

import rhinoscriptsyntax as rs

import Rhino.Geometry as rg
import math

def rotate_vector_to_angle(vector_b,vector_a, alpha_degrees):
    """
    Rotates vector B on the plane formed by vectors A and B, so that vector A and B form an angle Alpha on this plane.
    
    Args:
        vector_b: vector to rotate
        vector_a: reference vector
        alpha_degrees: The desired angle Alpha between Vector A and Vector B on their plane, in degrees (float)
    
    Returns:
        The rotated vector B (Rhino.Geometry.Vector3d)
    """
    # Calculate the rotation axis (normal to the plane formed by A and B)
    rotation_axis = rg.Vector3d.CrossProduct(vector_a, vector_b)
    rotation_axis.Unitize()  # Normalize the axis
    
    # Determine the current angle between A and B in radians
    current_angle = rg.Vector3d.VectorAngle(vector_a, vector_b)
    
    # Convert desired angle Alpha from degrees to radians
    alpha_radians = math.radians(alpha_degrees)
    
    # Calculate the angle difference needed for rotation
    angle_difference = alpha_radians - current_angle
    
    # Rotate vector B around the rotation axis by the angle difference
    rotated_vector_b = vector_b.Clone()  # Clone vector B to avoid modifying the original
    rotation_success = rotated_vector_b.Rotate(angle_difference, rotation_axis)  # Rotate
    
    # Check if the rotation was successful
    if rotation_success:
        return rotated_vector_b
    else:
        return None
        

def rotate_vector_around_axis(vector_to_rotate, axis_point, axis_direction, angle_degrees):
    """
    Rotates a vector around a given axis by a specified angle.

    Args:
        vector_to_rotate (rg.Vector3d): The vector to rotate.
        axis_point (rg.Point3d): A point that the axis of rotation passes through.
        axis_direction (rg.Vector3d): The direction vector of the axis of rotation.
        angle_degrees (float): The angle in degrees to rotate the vector.

    Returns:
        rg.Vector3d: The rotated vector.
    """
    # Convert the angle from degrees to radians
    angle_radians = math.radians(angle_degrees)
    
    # Create a rotation transformation
    rotation = rg.Transform.Rotation(angle_radians, axis_direction, axis_point)
    
    # Apply the rotation to the vector
    rotated_vector = vector_to_rotate.Clone()
    rotated_vector.Transform(rotation)
    
    return rotated_vector

def get_angle(v1,v2):
    tmp = math.degrees(rg.Vector3d.VectorAngle(v1,v2))
    theta = math.acos(v1 * v2 / (v1.Length * v2.Length))
    
    return tmp
    
def calculate_rotation_angle(original_vec, rotated_vec, rotation_axis):
    
    original_vec = project_onto_plane(original_vec,rotation_axis)
    rotated_vec = project_onto_plane(rotated_vec,rotation_axis)
        
    # Calculate the angle between the original and rotated vectors
    dot_product = rg.Vector3d.Multiply(original_vec, rotated_vec)
    magnitude_product = original_vec.Length * rotated_vec.Length
    
    angle_radians = math.acos(dot_product / magnitude_product)
    
    # Convert radians to degrees
    angle_degrees = math.degrees(angle_radians)
    
    # Determine the direction of rotation
    cross_product = rg.Vector3d.CrossProduct(original_vec, rotated_vec)
    direction = rg.Vector3d.Multiply(cross_product, rotation_axis)
    
    # If the direction is negative, adjust the angle to reflect the opposite rotation
    if direction < 0:
        angle_degrees = -angle_degrees
    
    return angle_degrees

def project_onto_plane(v, plane_normal):
    # print("v: ",v)
    # print("normal: ", plane_normal)
    plane_normal.Unitize()  # Ensure the normal is a unit vector
    dot_product = rg.Vector3d.Multiply(v, plane_normal)
    # print("dot:", dot_product)
    projection = v - (dot_product * plane_normal)
    
    return projection

def project_onto_axis(v, axis):
    axis.Unitize()  # Ensure the axis is a unit vector
    dot_product = rg.Vector3d.Multiply(v, axis)
    projection = dot_product * axis
    return projection
    

def deconstruct_poly(p):
    f_vectors = []
    r_angles = [0]
    f_angles = [0]
    lengths = []
    
    # init fold vectors 
    for i in range(p.SegmentCount):
                    
        vc = p.SegmentAt(i).Direction
        lengths.append(vc.Length)
        
        if i == 0:
            vn = p.SegmentAt(i+1).Direction
            fvec = project_onto_plane(vn,vc)
            fvec = rg.Vector3d.XAxis
        else:
            vp = p.SegmentAt(i-1).Direction 
            fvec = project_onto_plane(-vp,vc)
        
        f_vectors.append(fvec)

    
    for i in range(p.SegmentCount-1):
        
        projp = f_vectors[i]
        
        vi = p.SegmentAt(i).Direction
        vn = p.SegmentAt(i+1).Direction
        
        # projp = project_onto_plane(-vp,vi)
        projn = project_onto_plane(vn,vi)
        
        r = calculate_rotation_angle(projp,projn,vi)
        
        
        f = get_angle(vi,vn)
   
        
        test = rotate_vector_to_angle(projn,vi,f)
        test_angle =  get_angle(vi,test)
        print("seg %i test angle %f " % (i,test_angle))

        r_angles.append(round(r))
        f_angles.append(round(f))
        
    print("Fold vectors", f_vectors)
    print("rot angles", r_angles)
    print("fold angles", f_angles)
    print("lengths", lengths)
        
    return lengths, r_angles, f_angles, f_vectors
    
def construct_poly(lengths,r_angles,f_angles, origin = rg.Point3d(-15,0,0)):
    start_pt = origin
    points = [start_pt]
    
    fold_vector = rg.Vector3d.XAxis
    pt_vector = rg.Vector3d.ZAxis
    
    vectors = [pt_vector]
    
    for i,(l,r,f) in enumerate(zip(lengths,r_angles,f_angles)):
        
        p = points[-1]
        
        vp = vectors[-1]
        vc = vectors[-1]
        
        # update pt vector with fold angle
        if f != 0:
            vc = rotate_vector_to_angle(fold_vector, vp,f)
            # print("f",f)
        if r != 0:
            vc = rotate_vector_around_axis(vc, p, vp, r)
            # print("r",r)
        
        vc.Unitize()
        np = p + vc * l
        
        # calculate fold vector
        
        points.append(np)
        vectors.append(vc)
        
        if i >= 1 and f != 0: fold_vector = project_onto_plane(-vp,vc)
        # print("fold",fold_vector)
        
        
    polyline = rg.Polyline(points)
            
    return polyline
    
def divide_angles(lengths, r_angles, f_angles):
    print(">>>>>>> OLD FS: ", f_angles)
    print(">>>>>>> OLD RS: ", r_angles)
    print(">>>>>>> OLD LENGHTS: ", lengths)
    
    ls = []
    rs = []
    fs = []
    
    for l,r,f in zip(lengths,r_angles,f_angles):
        
        if f > 0:
            
            num = int(round(f / 20)) 
            
            f -= num * 20
            
            rs.append(r)
            rs.extend([0]*(num-1))
            ls.extend([0.5]*num)
            fs.extend([20]*(num))
            
            l -= num*0.5
            
        rs.append(0)
        ls.append(l)
        fs.append(0)
        
    print(">>>>>>>>>>>>>>> NEW FS",fs)
    print(">>>>>>>>>>>>>>> NEW LS",ls)
    print(">>>>>>>>>>>>>>> NEW RS",rs)
    
    if len(fs) != len(ls) or len(rs) != len(ls):
        print("error length")
    else:
        print("correct lengths !!!!!!!!")
    return ls, rs, fs
    

def poly2commands(lengths, r_angles, f_angles):
    
    cmds = []
    vals = []
    
    for l,r,f in zip(lengths,r_angles,f_angles):
        
        if f > 0:
            
            num = int(round(f / 20)) 
                        
            # rs.append(r)
            
            cmds.append('r')
            vals.append(r)
            
            cmds.append('f')
            vals.append(num)
            
            l -= num*0.5
            
        
        cnt = int(round(l/1))
        
        cmds.append('e')
        vals.append(cnt)
        
    if len(cmds) != len(vals):
        print("error length")
    else:
        print("correct lengths !!!!!!!!")
    return cmds,vals
    
    
# Example vector

p0 = rg.Point3d(0,0,0)
p1 = rg.Point3d(0,0,5)
p2 = rg.Point3d(5,5,5)
p3 = rg.Point3d(5,10,5)
p4 = rg.Point3d(0,10,0)

pl = rg.Polyline([p0,p1,p2,p3,p4])

print(pl.SegmentCount)

v0 = pl.SegmentAt(1).Direction
v1 = pl.SegmentAt(2).Direction
v2 = pl.SegmentAt(3).Direction


print(v0)
print(v1)
print(v2)

proj01 = project_onto_plane(-v0,v1)
proj21 = project_onto_plane(v2,v1)
print(proj01)
print(proj21)

angle = calculate_rotation_angle(proj01,proj21,v1)
print("rotation angle %f" % angle)

fold = get_angle(v1,v2)
f_r = 20 * round(fold/20)

print("fold angle %f" % fold)
print("rounded fold angle %f" % f_r)


test = rotate_vector_to_angle(proj21,v1,f_r)

proj_test = project_onto_plane(test,v1)


lengths, r_angles, f_angles, f_vectors = deconstruct_poly(pl)

f_angles = [round(f/20)*20 for f in f_angles]

pt = construct_poly(lengths, r_angles, f_angles)

new_ls,new_rs,new_fs = divide_angles(lengths, r_angles, f_angles)

pt2 = construct_poly(new_ls,new_rs,new_fs,origin=rg.Point3d(-15,20,0))

commands, values = poly2commands(lengths, r_angles, f_angles)


x = (',').join(commands)
y = (',').join(map(str,values))

print("commands: "+x)
print("values: "+y)

p = []
d = pl
a = pt
b = pt2
# ---------- end gh_vec_projection ----------
polyline_3 = PolyLine(Vertices=gh_vec_projection.b, Closed=False)
polyline_4 = PolyLine(Vertices=gh_vec_projection.d, Closed=False)
polyline_5 = PolyLine(Vertices=gh_vec_projection.a, Closed=False)
gh_vec_cross_products = GhPythonScript()  # -> out, vec, y, z, d
# ---------- gh_vec_cross_products: Python ----------
__author__ = "angelz"

import rhinoscriptsyntax as rs

import Rhino.Geometry as rg
import math

def rotate_vector_around_axis(vector_to_rotate, axis_point, axis_direction, angle_degrees):
    """
    Rotates a vector around a given axis by a specified angle.

    Args:
        vector_to_rotate (rg.Vector3d): The vector to rotate.
        axis_point (rg.Point3d): A point that the axis of rotation passes through.
        axis_direction (rg.Vector3d): The direction vector of the axis of rotation.
        angle_degrees (float): The angle in degrees to rotate the vector.

    Returns:
        rg.Vector3d: The rotated vector.
    """
    # Convert the angle from degrees to radians
    angle_radians = math.radians(angle_degrees)
    
    # Create a rotation transformation
    rotation = rg.Transform.Rotation(angle_radians, axis_direction, axis_point)
    
    # Apply the rotation to the vector
    rotated_vector = vector_to_rotate.Clone()
    rotated_vector.Transform(rotation)
    
    return rotated_vector

def get_angle(v1,v2):
    tmp = math.degrees(rg.Vector3d.VectorAngle(v1,v2))
    theta = math.acos(v1 * v2 / (v1.Length * v2.Length))
    
    return math.degrees(theta)
    
def calculate_rotation_angle(original_vec, rotated_vec, rotation_axis):
    
    original_vec = project_onto_plane(original_vec,rotation_axis)
    rotated_vec = project_onto_plane(rotated_vec,rotation_axis)
        
    # Calculate the angle between the original and rotated vectors
    dot_product = rg.Vector3d.Multiply(original_vec, rotated_vec)
    magnitude_product = original_vec.Length * rotated_vec.Length
    angle_radians = math.acos(dot_product / magnitude_product)
    
    # Convert radians to degrees
    angle_degrees = math.degrees(angle_radians)
    
    # Determine the direction of rotation
    cross_product = rg.Vector3d.CrossProduct(original_vec, rotated_vec)
    direction = rg.Vector3d.Multiply(cross_product, rotation_axis)
    
    # If the direction is negative, adjust the angle to reflect the opposite rotation
    if direction < 0:
        angle_degrees = -angle_degrees
    
    return angle_degrees

def project_onto_plane(v, plane_normal):
    plane_normal.Unitize()  # Ensure the normal is a unit vector
    dot_product = rg.Vector3d.Multiply(v, plane_normal)
    projection = v - (dot_product * plane_normal)
    return projection

def project_onto_axis(v, axis):
    axis.Unitize()  # Ensure the axis is a unit vector
    dot_product = rg.Vector3d.Multiply(v, axis)
    projection = dot_product * axis
    return projection
    
# Example vector
v = rg.Vector3d(0,1,1)

# World axes
x_axis = rg.Vector3d(1, 0, 0)
y_axis = rg.Vector3d(0, 1, 0)
z_axis = rg.Vector3d(0, 0, 1)

# Cross products
cross_with_x = rg.Vector3d.CrossProduct(v, x_axis)
cross_with_y = rg.Vector3d.CrossProduct(y_axis,v)
cross_with_z = rg.Vector3d.CrossProduct(v, z_axis)


v20 = rotate_vector_around_axis(v, rg.Point3d(0,0,0), rg.Vector3d.ZAxis, 20)
v180 = rotate_vector_around_axis(v, rg.Point3d(0,0,0), rg.Vector3d.ZAxis, 180)

v20_180 = rotate_vector_around_axis(v20, rg.Point3d(0,0,0), rg.Vector3d.ZAxis, 160)

angle = calculate_rotation_angle(v20,v20_180, rg.Vector3d.ZAxis)

print(angle)

x = v20
y = v180
z = v20_180

print("test angles")
print(get_angle(x,y))
print(get_angle(x,z))
print(get_angle(y,z))

d = v
# ---------- end gh_vec_cross_products ----------

# ---- group: _ARCHIVED / 1D 2 3D
curve_2 = Curve(<curve referenced from the Rhino model>)
ghpython_script = GhPythonScript(x=curve_2)  # -> out, a, b, c, d; disabled
# ---------- ghpython_script: Python ----------
__author__ = "angelz"

import rhinoscriptsyntax as rs
import Rhino.Geometry as rg
import math

def get_angle_deg(v1,v2):
    angle = rg.Vector3d.VectorAngle(v1,v2)
    dir = -1 if angle < 0 else 1
    return dir * math.degrees(abs(angle))


def project_onto_plane(v, plane_normal):
    print("test for angles BEFORE")
    a = get_angle_deg(v, plane_normal)
    print("angle", a)
    
    plane_normal.Unitize()  # Ensure the normal is a unit vector
    dot_product = rg.Vector3d.Multiply(v, plane_normal)  # Correctly calculate dot product
    # Removed the incorrect dot_product calculation
    t = project_onto_vec(v, plane_normal)
    
   # projection = v - (dot_product * plane_normal)
    
    projection = v - t
    
    print("proj",projection)
    print("normal",plane_normal)
    
    print("test for angles AFTER")
    a = get_angle_deg(projection,plane_normal)
    print("angle", a)
    
    print("project starts")
    print("Original vector length:", v.Length)
    print("Projected vector length:", projection.Length)
    print("project ends")
    
    return projection
    
    
def project_onto_vec(v, v2):
    v2.Unitize()  # Ensure the normal is a unit vector
    dot_product = rg.Vector3d.Multiply(v, v2)
    projection = (dot_product * v2)
    
    if projection.Length == 0: # the two vectors are already perpendicular, output original vector
        projection = v
        
    return projection
    
def calculate_rotation_angle(v1, v2, rotation_axis):
    print("before projection")
    print("v1",v1.Length,v1) 
    print("v2",v2.Length,v2) 
    print("rotation axis", rotation_axis)
    
    
    v1 = project_onto_plane(v1, rotation_axis)
    v2 = project_onto_plane(v2, rotation_axis)
   
    print(" after projection")
    print("v1", v1, v1.Length)
    print("v2", v2,v2.Length)
    
    # Calculate the angle between the original and rotated vectors
    dot_product = rg.Vector3d.Multiply(v1, v2)
    print("dot %f " %dot_product)
    magnitude_product = v1.Length * v2.Length
    print("mag %f" % magnitude_product)
    angle_radians = math.acos(dot_product / magnitude_product)
    
    print(angle_radians)
    
    # Convert radians to degrees
    angle_degrees = math.degrees(angle_radians)
    print(angle_degrees)
    
    # Determine the direction of rotation
    cross_product = rg.Vector3d.CrossProduct(v1, v2)
    direction = rg.Vector3d.Multiply(cross_product, rotation_axis)
    
    # If the direction is negative, adjust the angle to reflect the opposite rotation
    if direction < 0:
        angle_degrees = -angle_degrees
    
    return round(angle_degrees)

def rotate_vector_around_axis(vector, rotate_pt, rotate_axis, degrees):
    # Convert degrees to radians
    radians = math.radians(degrees)
    
    # Ensure the axis direction is a unit vector
    rotate_axis.Unitize()
    
    # Create a rotation transformation
    rotation = rg.Transform.Rotation(radians, rotate_axis, rotate_pt)
    
    # Apply the rotation to the vector
    # Note: To rotate a vector (not a point), we use the vector as a point relative to the origin (0,0,0),
    # and then convert the result back to a vector.
    rotated_point = rg.Point3d(vector.X, vector.Y, vector.Z)
    rotated_point.Transform(rotation)
    
    # Convert the rotated point back to a vector
    rotated_vector = rg.Vector3d(rotated_point.X, rotated_point.Y, rotated_point.Z)
    
    return rotated_vector

def polyline_analysis(polyline):
    # Ensure the polyline is valid
    if not polyline.IsValid or polyline.SegmentCount == 0:
        return None, None, None, None
        
    l = polyline.SegmentCount
    
    segment_lengths = []
    rotate_angles = [0]
    fold_angles = [0]
    
    fold_vector = rg.Vector3d.XAxis
    
    # Calculate segment lengths and base vector
    for i in range(l):
        segment = polyline.SegmentAt(i)
        segment_lengths.append(segment.Length)

    # Calculate transformation vectors for segment i to i+1
    for i in range(1, l):
        print("\n\n >>>>>>>>>>>>>>>>>>>>>>>.idx %i" % i)
        
        # prev segment direction vector
        v_prev = polyline.SegmentAt(i-1).Direction
        v_prev.Unitize()
        
        # current segment direction vector
        v_cur = polyline.SegmentAt(i).Direction
        v_cur.Unitize()
        
        
        fold_angle = get_angle_deg(v_prev,v_cur)
        fold_angles.append(round(fold_angle))
        
        
        if i != 1:
            fold_vector = project_onto_plane(-v_prev,v_cur)
        
        transform_fold = rg.Transform.Rotation(math.radians(fold_angle-90), v_prev, polyline[i])
        
        v_cur_1D = fold_vector.Clone()
        v_cur_1D.Transform(transform_fold)
        
        
        rotate_angle = calculate_rotation_angle(v_cur_1D, v_cur, v_prev)
        rotate_angles.append(rotate_angle-rotate_angles[-1])
        
        print("finish rotation")
        print(">>>>>>>>>>>>>>>>>>> idx %i \n" % i)
    
    print("length: ", segment_lengths)
    print("r angles: ", rotate_angles)
    print("f angles: ", fold_angles)
    
    return segment_lengths, rotate_angles, fold_angles

def construct_polyline(length, r_angles, f_angles):
    start_pt=rg.Point3d(-20,20,0)
    points = [start_pt]  # Initialize with the starting point
    current_direction = base_vector  # Start with the base vector for segment 0
    
    vectors = [current_direction]
    
    fold_vector = rg.Vector3d(1,0,0)
    
    rotate_vector
    
    # Assuming the rest of the function remains the same

    # Create and return the polyline from the list of points
    return rg.Polyline(points)


def polyline2commands(lengths, rotate_angles, fold_angles):   
    commands = ['e']
    values = [1]
    
    for i in range(len(lengths)):
        l = lengths[i]
        r = rotate_angles[i]
        f = fold_angles[i]
        
        if r != 0:
            commands.append('r')
            values.append(r)
        
        if f != 0:
            num = round(f/20)
            commands.append('f')
            values.append(num)
        
        l = round(l/3.6)
        commands.append('e')
        values.append(l*5)
    
    # data = {"commands": commands, "values":values}
    return commands, values
    
# Example usage:
# Create a sample polyline
points = [rg.Point3d(0, 0, 0),rg.Point3d(0, 0, 10),rg.Point3d(10, 0, 10),rg.Point3d(10, 10, 0)]
p = rg.Polyline(points)

a = p

seg_lengths, r_angles, f_angles = polyline_analysis(p)

# Construct the polyline
p2 = construct_polyline(seg_lengths,r_angles,f_angles)

t = get_angle_deg(rg.Vector3d.XAxis,rg.Vector3d.XAxis)
print(t)

a = p
b = p2
c =[]
d = []
# ---------- end ghpython_script ----------
polyline_6 = PolyLine(Vertices=ghpython_script.a, Closed=False)
polyline_7 = PolyLine(Vertices=ghpython_script.b, Closed=False)

# ---- group: _ARCHIVED / attempt1
curve_3 = Curve(<curve referenced from the Rhino model>)
ghpython_script_2 = GhPythonScript(x=curve_3)  # -> out, a, b, c, d; disabled
# ---------- ghpython_script_2: Python ----------
__author__ = "angelz"

import rhinoscriptsyntax as rs

import Rhino.Geometry as rg

import Rhino.Geometry as rg
import math

def cal_angles(polyline):
    angles = []
    # Check if the input is a polyline and has at least 3 points (for at least 2 segments)
    if not isinstance(polyline, rg.Polyline) or len(polyline) < 3:
        raise ValueError("Input must be a Polyline with at least 3 points.")
    
    # Iterate through the segments of the polyline to calculate angles
    for i in range(len(polyline) - 1):
        
        # Calculate vectors for consecutive segments
        vector_a = polyline[i] - polyline[i-1] if i != 0 else rg.Vector3d(0,0,1)
        vector_b = polyline[i+1] - polyline[i]
        
        # Normalize vectors to avoid influence of segment length on angle
        vector_a.Unitize()
        vector_b.Unitize()
        
        # Calculate angle between vectors in radians
        angle_radians = rg.Vector3d.VectorAngle(vector_a, vector_b)
        
        # Convert angle to degrees (optional)
        angle_degrees = math.degrees(angle_radians)
        
        # Add angle to the list
        angles.append(angle_degrees)
    
    print(angles)
    return angles
    
def rotate_vector_to_angle(vector_a, vector_b, alpha_degrees):
    """
    Rotates vector B on the plane formed by vectors A and B, so that vector A and B form an angle Alpha on this plane.
    
    Args:
        vector_a: Vector A (Rhino.Geometry.Vector3d)
        vector_b: Vector B (Rhino.Geometry.Vector3d)
        alpha_degrees: The desired angle Alpha between Vector A and Vector B on their plane, in degrees (float)
    
    Returns:
        The rotated vector B (Rhino.Geometry.Vector3d)
    """
    # Calculate the rotation axis (normal to the plane formed by A and B)
    rotation_axis = rg.Vector3d.CrossProduct(vector_a, vector_b)
    rotation_axis.Unitize()  # Normalize the axis
    
    # Determine the current angle between A and B in radians
    current_angle = rg.Vector3d.VectorAngle(vector_a, vector_b)
    
    # Convert desired angle Alpha from degrees to radians
    alpha_radians = math.radians(alpha_degrees)
    
    # Calculate the angle difference needed for rotation
    angle_difference = alpha_radians - current_angle
    
    # Rotate vector B around the rotation axis by the angle difference
    rotated_vector_b = vector_b.Clone()  # Clone vector B to avoid modifying the original
    rotation_success = rotated_vector_b.Rotate(angle_difference, rotation_axis)  # Rotate
    
    # Check if the rotation was successful
    if rotation_success:
        return rotated_vector_b
    else:
        return None

def polyline_analysis(polyline):
    # Ensure the polyline is valid
    if not polyline.IsValid or polyline.SegmentCount == 0:
        return None, None, None, None

    start_point = polyline[0]
    segment_lengths = []
    transformations = []
    rotate_angles = []
    
    fold_vector = rg.Vector3d(0,1,0)
    print(fold_vector)
    

    # Calculate segment lengths and base vector
    for i in range(polyline.SegmentCount):
        segment = polyline.SegmentAt(i)
        segment_lengths.append(segment.Length)
        if i == 0:
            base_vector = segment.Direction
            base_vector.Unitize()
            
            fold_vector = rg.Vector3d(0,0,1)
            fold_vector.Unitize()
            
            rotate_angles.append(0)
            

    # Calculate transformation vectors for segment i to i+1
    for i in range(1, polyline.SegmentCount):
        prev_segment = polyline.SegmentAt(i-1).Direction
        prev_segment.Unitize()
        
        current_segment = polyline.SegmentAt(i).Direction
        current_segment.Unitize()
        
        if i == 1:
            fold_vector = rg.Vector3d(1,0,0)
        
        angle = rg.Vector3d.VectorAngle(current_segment,fold_vector)
        angle = math.degrees(angle)
        
        rotate_angles.append(angle)
        
        # The transformation vector is the difference between the current segment direction and the previous one
        transformation_vector = current_segment - prev_segment
        transformations.append(transformation_vector)
        
        fold_vector = rg.Vector3d.CrossProduct(current_segment, prev_segment)
        
    return start_point, segment_lengths, base_vector, transformations, rotate_angles

def construct_polyline(start_pt, base_vector, segment_lengths, transformation_vectors):
    start_pt=rg.Point3d(-20,20,0)
    points = [start_pt]  # Initialize with the starting point
    current_direction = base_vector  # Start with the base vector for segment 0
    
    vectors = [current_direction]
    
    fold_vector = rg.Vector3d(1,0,0)
    
    # Assuming the rest of the function remains the same

    for i, length in enumerate(segment_lengths):
        
        # angle = math.degrees(rg.Vector3d.VectorAngle(fold_vector,current_direction))
        # print("old angle %f" % angle)
        # angle = 20 * round(angle/20)
        # print("new angle %i" % angle)
        prev_dir = vectors[-1] if i>0 else rg.Vector3d(0,0,1)
        angle = math.degrees(rg.Vector3d.VectorAngle(prev_dir,current_direction))
        angle = 20 * round(angle/20)
    
        
        current_direction = rotate_vector_to_angle(prev_dir, current_direction, angle)
     
        
        # angle = math.degrees(rg.Vector3d.VectorAngle(fold_vector,vectors[-1]))
        # print("fold vs prev %f" % angle)
        
        vectors.append(current_direction)
        
        # Normalize the current direction and scale it by the segment length
        scaled_vector = current_direction
        scaled_vector.Unitize()
        scaled_vector *= length
        
        # print("length %f " % length)
        
        # Calculate the next point and add it to the list
        next_point = points[-1] + scaled_vector
        points.append(next_point)
        
        
        
        # Update the direction for the next segment using the transformation vector
        # The transformation vector is applied differently here based on the corrected understanding
        if i < len(transformation_vectors):
            current_direction += transformation_vectors[i]
            
            fold_vector = rg.Vector3d.CrossProduct(vectors[-2], vectors[-1])


            # Ensure current_direction is updated properly here according to the new logic


    # Create and return the polyline from the list of points
    return rg.Polyline(points)

def adjust_polyline_angles(p):
    return 0

def polyline2commands(lengths, rotate_angles, fold_angles):   
    commands = ['e']
    values = [1]
    
    for i in range(len(lengths)):
        l = lengths[i]
        r = rotate_angles[i]
        f = fold_angles[i]
        
        if r != 0:
            commands.append('r')
            values.append(r)
        
        if f != 0:
            num = round(f/20)
            commands.append('f')
            values.append(num)
        
        l = round(l/3.6)
        commands.append('e')
        values.append(l*5)
    
    # data = {"commands": commands, "values":values}
    return commands, values
    
# Example usage:
# Create a sample polyline
points = [rg.Point3d(0, 0, 0),rg.Point3d(0, 0, 10),rg.Point3d(10, 0, 0), rg.Point3d(10, 10, 0), rg.Point3d(20, 10, 0)]
polyline = rg.Polyline(points)

polyline = rs.coercecurve(x).ToPolyline()

print("raw angles")
fold_angles = cal_angles(polyline)

start_pt, segment_lengths, base_vector, transformation_vectors, rotate_angles = polyline_analysis(polyline)

print(len(segment_lengths))
print(len(rotate_angles))
print(fold_angles)

# Construct the polyline
p2 = construct_polyline(start_pt, base_vector, segment_lengths, transformation_vectors)

print("rounded angles")
fold_angles = cal_angles(p2)

polyline_analysis(p2)

commands, values = polyline2commands(segment_lengths,rotate_angles, fold_angles)

a = polyline
b = p2
c = ','.join(commands)
print(c)
d = ','.join(map(str,values))
print(d)
# ---------- end ghpython_script_2 ----------
polyline_8 = PolyLine(Vertices=ghpython_script_2.a, Closed=False)
polyline_9 = PolyLine(Vertices=ghpython_script_2.b, Closed=False)

# ---- group: 3D Polyline To Commands & Visualization / POLYLINE / CURVE
curve_resolution = Slider(69, range=0..100)
curve_4 = Curve(<curve referenced from the Rhino model>)
curve_to_polyline = CurveToPolyline(Curve=curve_4, ToleranceDistance=0, ToleranceAngle=0, MinEdge=curve_resolution)  # -> Polyline, Segments

# ---- group: Load Line from CV
ghpython_script_3 = GhPythonScript()  # -> out, a, b
# ---------- ghpython_script_3: Python ----------
import rhinoscriptsyntax as rs
import Rhino.Geometry as rg

# File path to the text file containing the 3D positions
file_path = "/Users/angelz/Desktop/index_tip_positions3D.txt"

# Function to read points from file
def read_points_from_file(file_path,thres=3):
    print(file_path)
    x_base = 0
    y_base = 0
    z_base = 0
    points = []
    with open(file_path, 'r') as file:
        print(file)
        for line in file:
            x, y, z = map(float, line.strip().split(','))
            if len(points) < 1:
                x_base = x
                y_base = y
                z_base = z
            points.append(rg.Point3d((x-x_base)/thres, (y-y_base)/thres, (z-z_base)/thres))
    return points

# Read the points from the file
points = read_points_from_file(file_path)

# Check if points list is not empty
if points:
    l= len(points)
    points = points[int(round(l/3)):int(round(1.7*l/3))]
    # Create a 3D polyline from the points
    polyline = rg.Polyline(points)
    
    # Smoothing the polyline - adjust tolerance as needed
    tolerance = 1.0  # Smoothing tolerance, adjust based on your needs
    smoothed_polyline = polyline.ToNurbsCurve().Rebuild(20, 5, True)  # Adjust control points and degree as needed
    
    # Output the smoothed polyline
    # a = polyline
    b = smoothed_polyline
else:
    a,b = None,None
# ---------- end ghpython_script_3 ----------

# ----
curve_resolution_2 = Slider(34, range=0..100)
curve_5 = Curve(<curve referenced from the Rhino model>)
curve_to_polyline_2 = CurveToPolyline(Curve=curve_5, ToleranceDistance=0, ToleranceAngle=0, MinEdge=curve_resolution_2)  # -> Polyline, Segments
number_slider = Slider(4, range=0..10)
number_slider_2 = Slider(4, range=0..10)
folder_path_for_commands = Panel("/Users/angelz/Desktop/tubable/Step/python-step/gh_motor_pipeline")
curve_6 = Curve(<curve referenced from the Rhino model>)
panel_3 = Panel("/Users/willayang/Documents/tubable-github/tubable/Step/python-step/gh_motor_pipeline")
tube_len_sections = Panel("90")
tube_len_sections_2 = Panel("60")
h_bellow_mm = Panel("4")
od_mm = Panel("11")
theta_deg = Panel("18")
tube_len_sections_3 = Panel("80")
tube_len_sections_4 = Panel("300")
ply_2_cmds_lll = GhPythonScript(tube_len=tube_len_sections, max_fold=number_slider)  # -> out, x, y, a, b, c; disabled
# ---------- ply_2_cmds_lll: Python ----------
import rhinoscriptsyntax as rs
import Rhino.Geometry as rg
import math

SIZE_CHOICE = 2 # Change as needed
MAX_FOLD = 4

# 0 small, 1 middle, 2 large

# Parameter sets
params_small = {
    "H_EXPANDED": 3.5,             # Offset distance for command 'e'
    "H_COLLAPSED": 1,
    "THETA": 18,        # Rotation angle for command 'f'
    "ROTATE_F_LENGTH": 4.5,      # Folded side length
    "OD": 11.0,
}

params_middle = {
    "H_EXPANDED": 6.3,             # Expanded offset height
    "H_COLLAPSED": 2,
    "THETA": 14.5,        # Theta (deg)
    "ROTATE_F_LENGTH": 7.5,      # Folded side length
    "OD": 29.0,  # Outer diameter (OD)
}

params_large = {
    "H_EXPANDED": 10.0,            # Expanded offset height
    "H_COLLAPSED": 4,
    "THETA": 14.5,        # Theta (deg)
    "ROTATE_F_LENGTH": 12,     # Folded side length
    "OD": 46.0,  # Outer diameter (OD)
}
size = SIZE_CHOICE

if size == 1:
    params = params_middle
elif size == 2:
    params = params_large
else:
    params = params_small
# Global variables from chosen set
H_EXPANDED = params["H_EXPANDED"]
THETA = params["THETA"]
OD = params["OD"]
H_FOLDED = math.sin(math.radians(THETA) / 2) * OD * 1.1

####################################
# helper
####################################

def calc_angle_replace_dist(x, dF = H_FOLDED, theta = THETA):
    # x = num of theta (angle A = x theta)
    angle_arc_radius = dF / (2 * math.sin(theta/2))
    angle_distance = math.tan(x * theta / 2) * angle_arc_radius
    return abs(angle_distance)

angle_dist_dict = {0:0}
max_num_theta = int(math.ceil(180/THETA))
for i in range(1,max_num_theta):
    distance = calc_angle_replace_dist(i, H_FOLDED, THETA)
    angle_dist_dict[i] = distance

####################################
# vector operation utility 
####################################

def get_abs_cos(deg):
    return abs(math.cos(math.radians(deg)))

####################################
# deconstruct polyline & get segment lengths, fold angles, rotation angles
####################################
def project_onto_plane(v, plane_normal):
    if v.IsZero or plane_normal.IsZero:
        return rg.Vector3d.Zero
    n = rg.Vector3d(plane_normal)
    n.Unitize()
    projected = v - (v * n) * n  # Remove component along normal
    if projected.IsZero:
        return rg.Vector3d.Zero
    projected.Unitize()
    return projected

def calculate_rotation_angle2(original_vec, rotated_vec, rotation_axis):
    original_vec, rotated_vec = [project_onto_plane(v, rotation_axis) for v in [original_vec, rotated_vec]]
    if not original_vec.Length or not rotated_vec.Length: return 0
    angle = rg.Vector3d.VectorAngle(original_vec, rotated_vec)
    angle = round(math.degrees(angle))
    if rg.Vector3d.CrossProduct(original_vec, rotated_vec) * rotation_axis < 0: angle = -angle
    return angle

def calculate_rotation_angle(v1, v2, axis):
    # Project both vectors onto plane orthogonal to axis
    v1_proj = project_onto_plane(v1, axis)
    v2_proj = project_onto_plane(v2, axis)

    if v1_proj.IsZero or v2_proj.IsZero:
        return 0

    angle_rad = rg.Vector3d.VectorAngle(v1_proj, v2_proj)
    angle_deg = math.degrees(angle_rad)

    # Determine sign using cross product direction
    cross = rg.Vector3d.CrossProduct(v1_proj, v2_proj)
    if cross * axis < 0:
        angle_deg = -angle_deg

    return angle_deg

def poly2shape(p):
    r_angles = [0]
    f_angles = [0]
    lengths = [p.SegmentAt(0).Length]
    for i in range(p.SegmentCount-1):
        vi = p.SegmentAt(i).Direction
        vn = p.SegmentAt(i+1).Direction 
        projp = project_onto_plane(-p.SegmentAt(i-1).Direction, vi) if i else rg.Vector3d.XAxis
        projn = project_onto_plane(vn,vi)
        f = math.degrees(rg.Vector3d.VectorAngle(vi, vn))
        r = calculate_rotation_angle(projp,projn,vi) if f else 0
        if r < THETA / 2: r = 0
        r_angles.append(r)
        f_angles.append(f)
        lengths.append(vn.Length)
    return lengths, r_angles, f_angles



####################################
# main operation on polyline
####################################

def vis_poly(lengths, r_angles, f_x_theta):
    
    f_angles = [math.radians(THETA * x) for x in f_x_theta] # all convert to radians
    r_angles = [math.radians(r) for r in r_angles] # convert to radian
    pt = rg.Point3d(0, 0, 0)
    direction = rg.Vector3d.ZAxis
    up = rg.Vector3d.XAxis
    points = [pt]

    for i in range(len(lengths)):
        # Apply rotation if needed
        if i > 0:
            r = r_angles[i]
            if r != 0:
                rot = rg.Transform.Rotation(r, direction, pt)
                up.Transform(rot)

            f = f_angles[i]
            if f != 0:
                rot = rg.Transform.Rotation(f, up, pt)
                direction.Transform(rot)
        pt = pt + direction * lengths[i]
        points.append(rg.Point3d(pt))

    p_rounded = rg.Polyline(points)
    return p_rounded

def rotate_vector_to_angle(v2, v1, alpha_degrees):
    rotation_axis = rg.Vector3d.CrossProduct(v1, v2)
    rotation_axis.Unitize()
    rotated_v2 = v1.Clone()
    alpha_radians = math.radians(alpha_degrees)
    rotation_success = rotated_v2.Rotate(alpha_radians, rotation_axis)
    return rotated_v2 if rotation_success else None

def rotate_vector_around_axis(vector_to_rotate, axis_point, axis_direction, angle_degrees):
    if not axis_direction.IsUnitVector:
        axis_direction.Unitize()
    angle_radians = math.radians(angle_degrees)
    rotation = rg.Transform.Rotation(angle_radians, axis_direction, axis_point)
    rotated_vector = vector_to_rotate.Clone()
    rotated_vector.Transform(rotation)
    return rotated_vector

def construct_poly(lengths,r_angles,f_x_theta, origin = rg.Point3d(0,0,0)):
    f_angles = [THETA * x for x in f_x_theta] # all convert to radians
    # f_angles = f_x_theta
    points = [origin]
    fold_vector = rg.Vector3d.XAxis
    vectors = [rg.Vector3d.ZAxis]

    for i,(l,r,f) in enumerate(zip(lengths,r_angles,f_angles)):
        pt = points[-1]
        vp = vectors[-1]
        vc = vp
        
        if f: vc = rotate_vector_to_angle(fold_vector,vp,f)
        if f and r: vc = rotate_vector_around_axis(vc, pt, vp, r)
        vc.Unitize()
        np = pt + vc * l
    
        points.append(np)
        vectors.append(vc)
        
        if i > 0 and f: fold_vector = project_onto_plane(-vp,vc)
            
    polyline = rg.Polyline(points)
            
    return polyline



#######################################
def shape2tube(lengths, r_angles, f_angles, pl, max_fold=MAX_FOLD, shortest_seg = 3):
    # convert to degrees
    f_x_theta = [int(round(f / THETA)) for f in f_angles]
    X_180 = int(round(180 / THETA)) # future work
    cmds = []
    vals = []
    new_ls = []
    new_rs = []
    new_f_x_theta = []
    # pl_rounded = vis_poly(lengths,r_angles,f_x_theta)
    pl_rounded = construct_poly(lengths, r_angles, f_x_theta)
    
    for i,(l,r,cur_x) in enumerate(zip(lengths,r_angles,f_x_theta)):

        new_l = l
        if i+1 < len(lengths): # adjust segment length based on next angle
            next_x = f_x_theta[i+1]
            next_rm_distance = calc_angle_replace_dist(next_x)
            new_l -= next_rm_distance 
            print("next remove")
            print(next_rm_distance)
        if cur_x != 0: # adjust segment length based on cur fold angle
            # this is the fold angle before cur segment
            cmds.append('r') # no need for rotation processing, directly append
            vals.append(r)
            new_rs.append(r)
            cur_rm_distance = 0
            if cur_x != X_180:
                cur_rm_distance += calc_angle_replace_dist(cur_x)
                print("cur remove")
                print(cur_rm_distance)
            if cur_x <= 4:
                cmds.append('f')
                vals.append(cur_x)

                new_rs.extend([0] * cur_x)
                new_ls.extend([H_FOLDED] * cur_x)
                new_f_x_theta.extend([1] * cur_x)
            elif cur_x <= 6:
                cmds+=['f','e','f']
                vals+=[3,1,cur_x-3]
                cur_rm_distance += H_EXPANDED

                new_rs.extend([0] * 3)
                new_ls.extend([H_FOLDED] * 3)
                new_f_x_theta.extend([1] * 3)
                new_rs.append(0)
                new_f_x_theta.append(0)
                new_ls.append(H_EXPANDED)
                new_rs.extend([0] * (cur_x-3))
                new_ls.extend([H_FOLDED] * (cur_x-3))
                new_f_x_theta.extend([1] * (cur_x-3))
            else:
                cmds+=['f','e','f']
                vals+=[4,1,cur_x-4]
                cur_rm_distance += H_EXPANDED

                new_rs.extend([0] * 4)
                new_ls.extend([H_FOLDED] * 4)
                new_f_x_theta.extend([1] * 4)
                new_rs.append(0)
                new_f_x_theta.append(0)
                new_ls.append(H_EXPANDED)
                new_rs.extend([0] * (cur_x-4))
                new_ls.extend([H_FOLDED] * (cur_x-4))
                new_f_x_theta.extend([1] * (cur_x-4))

            new_l -= cur_rm_distance
        else:
            new_rs.append(0)

        cnt = int(round(new_l/H_EXPANDED))
        if cnt < 1: # 
            cnt = 1
            new_l = 1 * H_EXPANDED
            print("Warning, segment length to short, lengthened")

        new_ls.append(new_l)
        # new_rs.append[0]
        new_f_x_theta.append(0)

        cmds.append('e')
        vals.append(cnt)

    print(new_ls, new_rs, new_f_x_theta)
    pl_tube = construct_poly(new_ls,new_rs,new_f_x_theta)
    return cmds,vals,pl_rounded,pl_tube
    

####################################
# preprocess polyline 
####################################

def combine_collinear_segments(polyline, tolerance=1e-3):
    l = len(polyline)
    if l < 3:
        return rg.Polyline(polyline)  # Nothing to simplify

    new_points = [polyline[0]]
    for i in range(1, l - 1):
        prev_pt, curr_pt, next_pt = polyline[i - 1], polyline[i], polyline[i + 1]
        v1 = curr_pt - prev_pt
        v2 = next_pt - curr_pt

        if not v1.IsZero and not v2.IsZero:
            v1.Unitize()
            v2.Unitize()
            dot = v1 * v2
            if abs(dot) < (1 - tolerance):  # Not collinear
                new_points.append(curr_pt)
    new_points.append(polyline[l-1])
    return rg.Polyline(new_points)

def process_polyline(curve, target_length, offset_z=H_EXPANDED, add_z = True):
    pl = rs.coercecurve(curve).ToPolyline()
    pl = combine_collinear_segments(pl)
    # 
    length = sum(seg.Length for seg in pl.GetSegments())
    if length == 0:
        return pl
    scale = target_length / length
    pl_scaled = rg.Polyline(pl)
    pl_scaled.Transform(rg.Transform.Scale(pl[0], scale))
    
    if add_z:
    # 2. Add vertical Z-segment
        offset_point = rg.Point3d(pl_scaled[0].X, pl_scaled[0].Y, pl_scaled[0].Z - offset_z)
        pl_shifted = rg.Polyline([offset_point] + list(pl_scaled))
        pl_shifted.Transform(rg.Transform.Translation(rg.Vector3d(0, 0, offset_z)))
    # TODO: If not add_z, rotate pl to align 1st seg with z, maybe not necessary

    return pl_shifted

####################################
# MAIN
####################################

# input x - a polyline
# input tube_len - tube length
    
# pl = rs.coercecurve(x).ToPolyline()
target_length = 60 * H_EXPANDED
if isinstance(tube_len, str):
    target_length = int(tube_len) * H_EXPANDED
polyline = process_polyline(x, target_length)

lengths, r_angles, f_angles = poly2shape(polyline)

if max_fold:
    print("get max fold input")
    max_fold = int(round(max_fold))
    print(max_fold)

commands, values, pl_rounded, pl_tube = shape2tube(lengths, r_angles, f_angles,max_fold)

x = (',').join(commands)
y = (',').join(map(str,values))

translation = rg.Vector3d(20, 0, 0)
xform = rg.Transform.Translation(translation)
polyline.Transform(xform)

# vis polyline - scaled 
a = polyline
b = pl_rounded
c = pl_tube

print(x)
print(y)
# ---------- end ply_2_cmds_lll ----------
ply_2_cmds = GhPythonScript(tube_len=tube_len_sections_3, max_fold=number_slider)  # -> out, x, y, a, b, c; disabled
# ---------- ply_2_cmds: Python ----------
import rhinoscriptsyntax as rs
import Rhino.Geometry as rg
import math

SIZE_CHOICE = 1 # Change as needed
MAX_FOLD = 4

# 0 small, 1 middle, 2 large

# Parameter sets
params_small = {
    "H_EXPANDED": 3.5,             # Offset distance for command 'e'
    "H_COLLAPSED": 1,
    "THETA": 18,        # Rotation angle for command 'f'
    "ROTATE_F_LENGTH": 4.5,      # Folded side length
    "OD": 11.0,
}

params_middle = {
    "H_EXPANDED": 6.3,             # Expanded offset height
    "H_COLLAPSED": 2,
    "THETA": 14.5,        # Theta (deg)
    "ROTATE_F_LENGTH": 7.5,      # Folded side length
    "OD": 29.0,  # Outer diameter (OD)
}

params_large = {
    "H_EXPANDED": 10.0,            # Expanded offset height
    "H_COLLAPSED": 4,
    "THETA": 14.5,        # Theta (deg)
    "ROTATE_F_LENGTH": 12,     # Folded side length
    "OD": 46.0,  # Outer diameter (OD)
}
size = SIZE_CHOICE

if size == 1:
    params = params_middle
elif size == 2:
    params = params_large
else:
    params = params_small
# Global variables from chosen set
H_EXPANDED = params["H_EXPANDED"]
THETA = params["THETA"]
OD = params["OD"]
H_FOLDED = math.sin(math.radians(THETA) / 2) * OD * 1.1

####################################
# helper
####################################

def calc_angle_replace_dist(x, dF = H_FOLDED, theta = THETA):
    # x = num of theta (angle A = x theta)
    angle_arc_radius = dF / (2 * math.sin(theta/2))
    angle_distance = math.tan(x * theta / 2) * angle_arc_radius
    return abs(angle_distance)

angle_dist_dict = {0:0}
max_num_theta = int(math.ceil(180/THETA))
for i in range(1,max_num_theta):
    distance = calc_angle_replace_dist(i, H_FOLDED, THETA)
    angle_dist_dict[i] = distance

####################################
# vector operation utility 
####################################

def get_abs_cos(deg):
    return abs(math.cos(math.radians(deg)))

####################################
# deconstruct polyline & get segment lengths, fold angles, rotation angles
####################################
def project_onto_plane(v, plane_normal):
    if v.IsZero or plane_normal.IsZero:
        return rg.Vector3d.Zero
    n = rg.Vector3d(plane_normal)
    n.Unitize()
    projected = v - (v * n) * n  # Remove component along normal
    if projected.IsZero:
        return rg.Vector3d.Zero
    projected.Unitize()
    return projected

def calculate_rotation_angle2(original_vec, rotated_vec, rotation_axis):
    original_vec, rotated_vec = [project_onto_plane(v, rotation_axis) for v in [original_vec, rotated_vec]]
    if not original_vec.Length or not rotated_vec.Length: return 0
    angle = rg.Vector3d.VectorAngle(original_vec, rotated_vec)
    angle = round(math.degrees(angle))
    if rg.Vector3d.CrossProduct(original_vec, rotated_vec) * rotation_axis < 0: angle = -angle
    return angle

def calculate_rotation_angle(v1, v2, axis):
    # Project both vectors onto plane orthogonal to axis
    v1_proj = project_onto_plane(v1, axis)
    v2_proj = project_onto_plane(v2, axis)

    if v1_proj.IsZero or v2_proj.IsZero:
        return 0

    angle_rad = rg.Vector3d.VectorAngle(v1_proj, v2_proj)
    angle_deg = math.degrees(angle_rad)

    # Determine sign using cross product direction
    cross = rg.Vector3d.CrossProduct(v1_proj, v2_proj)
    if cross * axis < 0:
        angle_deg = -angle_deg

    return angle_deg

def poly2shape(p):
    r_angles = [0]
    f_angles = [0]
    lengths = [p.SegmentAt(0).Length]
    for i in range(p.SegmentCount-1):
        vi = p.SegmentAt(i).Direction
        vn = p.SegmentAt(i+1).Direction 
        projp = project_onto_plane(-p.SegmentAt(i-1).Direction, vi) if i else rg.Vector3d.XAxis
        projn = project_onto_plane(vn,vi)
        f = math.degrees(rg.Vector3d.VectorAngle(vi, vn))
        r = calculate_rotation_angle(projp,projn,vi) if f else 0
        if r < THETA / 2: r = 0
        r_angles.append(r)
        f_angles.append(f)
        lengths.append(vn.Length)
    return lengths, r_angles, f_angles



####################################
# main operation on polyline
####################################

def vis_poly(lengths, r_angles, f_x_theta):
    
    f_angles = [math.radians(THETA * x) for x in f_x_theta] # all convert to radians
    r_angles = [math.radians(r) for r in r_angles] # convert to radian
    pt = rg.Point3d(0, 0, 0)
    direction = rg.Vector3d.ZAxis
    up = rg.Vector3d.XAxis
    points = [pt]

    for i in range(len(lengths)):
        # Apply rotation if needed
        if i > 0:
            r = r_angles[i]
            if r != 0:
                rot = rg.Transform.Rotation(r, direction, pt)
                up.Transform(rot)

            f = f_angles[i]
            if f != 0:
                rot = rg.Transform.Rotation(f, up, pt)
                direction.Transform(rot)
        pt = pt + direction * lengths[i]
        points.append(rg.Point3d(pt))

    p_rounded = rg.Polyline(points)
    return p_rounded

def rotate_vector_to_angle(v2, v1, alpha_degrees):
    rotation_axis = rg.Vector3d.CrossProduct(v1, v2)
    rotation_axis.Unitize()
    rotated_v2 = v1.Clone()
    alpha_radians = math.radians(alpha_degrees)
    rotation_success = rotated_v2.Rotate(alpha_radians, rotation_axis)
    return rotated_v2 if rotation_success else None

def rotate_vector_around_axis(vector_to_rotate, axis_point, axis_direction, angle_degrees):
    if not axis_direction.IsUnitVector:
        axis_direction.Unitize()
    angle_radians = math.radians(angle_degrees)
    rotation = rg.Transform.Rotation(angle_radians, axis_direction, axis_point)
    rotated_vector = vector_to_rotate.Clone()
    rotated_vector.Transform(rotation)
    return rotated_vector

def construct_poly(lengths,r_angles,f_x_theta, origin = rg.Point3d(0,0,0)):
    f_angles = [THETA * x for x in f_x_theta] # all convert to radians
    # f_angles = f_x_theta
    points = [origin]
    fold_vector = rg.Vector3d.XAxis
    vectors = [rg.Vector3d.ZAxis]

    for i,(l,r,f) in enumerate(zip(lengths,r_angles,f_angles)):
        pt = points[-1]
        vp = vectors[-1]
        vc = vp
        
        if f: vc = rotate_vector_to_angle(fold_vector,vp,f)
        if f and r: vc = rotate_vector_around_axis(vc, pt, vp, r)
        vc.Unitize()
        np = pt + vc * l
    
        points.append(np)
        vectors.append(vc)
        
        if i > 0 and f: fold_vector = project_onto_plane(-vp,vc)
            
    polyline = rg.Polyline(points)
            
    return polyline



#######################################
def shape2tube(lengths, r_angles, f_angles, pl, max_fold=MAX_FOLD, shortest_seg = 3):
    # convert to degrees
    f_x_theta = [int(round(f / THETA)) for f in f_angles]
    X_180 = int(round(180 / THETA)) # future work
    cmds = []
    vals = []
    new_ls = []
    new_rs = []
    new_f_x_theta = []
    # pl_rounded = vis_poly(lengths,r_angles,f_x_theta)
    pl_rounded = construct_poly(lengths, r_angles, f_x_theta)
    
    for i,(l,r,cur_x) in enumerate(zip(lengths,r_angles,f_x_theta)):

        new_l = l
        if i+1 < len(lengths): # adjust segment length based on next angle
            next_x = f_x_theta[i+1]
            next_rm_distance = calc_angle_replace_dist(next_x)
            new_l -= next_rm_distance 
            print("next remove")
            print(next_rm_distance)
        if cur_x != 0: # adjust segment length based on cur fold angle
            # this is the fold angle before cur segment
            cmds.append('r') # no need for rotation processing, directly append
            vals.append(r)
            new_rs.append(r)
            cur_rm_distance = 0
            if cur_x != X_180:
                cur_rm_distance += calc_angle_replace_dist(cur_x)
                print("cur remove")
                print(cur_rm_distance)
            if cur_x <= 4:
                cmds.append('f')
                vals.append(cur_x)

                new_rs.extend([0] * cur_x)
                new_ls.extend([H_FOLDED] * cur_x)
                new_f_x_theta.extend([1] * cur_x)
            elif cur_x <= 6:
                cmds+=['f','e','f']
                vals+=[3,1,cur_x-3]
                cur_rm_distance += H_EXPANDED

                new_rs.extend([0] * 3)
                new_ls.extend([H_FOLDED] * 3)
                new_f_x_theta.extend([1] * 3)
                new_rs.append(0)
                new_f_x_theta.append(0)
                new_ls.append(H_EXPANDED)
                new_rs.extend([0] * (cur_x-3))
                new_ls.extend([H_FOLDED] * (cur_x-3))
                new_f_x_theta.extend([1] * (cur_x-3))
            else:
                cmds+=['f','e','f']
                vals+=[4,1,cur_x-4]
                cur_rm_distance += H_EXPANDED

                new_rs.extend([0] * 4)
                new_ls.extend([H_FOLDED] * 4)
                new_f_x_theta.extend([1] * 4)
                new_rs.append(0)
                new_f_x_theta.append(0)
                new_ls.append(H_EXPANDED)
                new_rs.extend([0] * (cur_x-4))
                new_ls.extend([H_FOLDED] * (cur_x-4))
                new_f_x_theta.extend([1] * (cur_x-4))

            new_l -= cur_rm_distance
        else:
            new_rs.append(0)

        cnt = int(round(new_l/H_EXPANDED))
        if cnt < 1: # 
            cnt = 1
            new_l = 1 * H_EXPANDED
            print("Warning, segment length to short, lengthened")

        new_ls.append(new_l)
        # new_rs.append[0]
        new_f_x_theta.append(0)

        cmds.append('e')
        vals.append(cnt)

    print(new_ls, new_rs, new_f_x_theta)
    pl_tube = construct_poly(new_ls,new_rs,new_f_x_theta)
    return cmds,vals,pl_rounded,pl_tube
    

####################################
# preprocess polyline 
####################################

def combine_collinear_segments(polyline, tolerance=1e-3):
    l = len(polyline)
    if l < 3:
        return rg.Polyline(polyline)  # Nothing to simplify

    new_points = [polyline[0]]
    for i in range(1, l - 1):
        prev_pt, curr_pt, next_pt = polyline[i - 1], polyline[i], polyline[i + 1]
        v1 = curr_pt - prev_pt
        v2 = next_pt - curr_pt

        if not v1.IsZero and not v2.IsZero:
            v1.Unitize()
            v2.Unitize()
            dot = v1 * v2
            if abs(dot) < (1 - tolerance):  # Not collinear
                new_points.append(curr_pt)
    new_points.append(polyline[l-1])
    return rg.Polyline(new_points)

def process_polyline(curve, target_length, offset_z=H_EXPANDED, add_z = True):
    pl = rs.coercecurve(curve).ToPolyline()
    pl = combine_collinear_segments(pl)
    # 
    length = sum(seg.Length for seg in pl.GetSegments())
    if length == 0:
        return pl
    scale = target_length / length
    pl_scaled = rg.Polyline(pl)
    pl_scaled.Transform(rg.Transform.Scale(pl[0], scale))
    
    if add_z:
    # 2. Add vertical Z-segment
        offset_point = rg.Point3d(pl_scaled[0].X, pl_scaled[0].Y, pl_scaled[0].Z - offset_z)
        pl_shifted = rg.Polyline([offset_point] + list(pl_scaled))
        pl_shifted.Transform(rg.Transform.Translation(rg.Vector3d(0, 0, offset_z)))
    # TODO: If not add_z, rotate pl to align 1st seg with z, maybe not necessary

    return pl_shifted

####################################
# MAIN
####################################

# input x - a polyline
# input tube_len - tube length
    
# pl = rs.coercecurve(x).ToPolyline()
target_length = 60 * H_EXPANDED
if isinstance(tube_len, str):
    target_length = int(tube_len) * H_EXPANDED
polyline = process_polyline(x, target_length)

lengths, r_angles, f_angles = poly2shape(polyline)

if max_fold:
    print("get max fold input")
    max_fold = int(round(max_fold))
    print(max_fold)

commands, values, pl_rounded, pl_tube = shape2tube(lengths, r_angles, f_angles,max_fold)

x = (',').join(commands)
y = (',').join(map(str,values))

translation = rg.Vector3d(20, 0, 0)
xform = rg.Transform.Translation(translation)
polyline.Transform(xform)

# vis polyline - scaled 
a = polyline
b = pl_rounded
c = pl_tube

print(x)
print(y)
# ---------- end ply_2_cmds ----------
curve_7 = Curve()
ply_2_cmds_sss = GhPythonScript(tube_len=tube_len_sections_2, max_fold=number_slider, h_bellow=h_bellow_mm, OD=od_mm, theta=theta_deg)  # -> out, x, y, a, b, c; disabled
# ---------- ply_2_cmds_sss: Python ----------
import rhinoscriptsyntax as rs
import Rhino.Geometry as rg
import math

SIZE_CHOICE = 0 # Change as needed
MAX_FOLD = 4
CUSTOM = 1

# 0 small, 1 middle, 2 large

# Parameter sets
params_small = {
    "H_EXPANDED": 3.5,             # Offset distance for command 'e'
    "H_COLLAPSED": 1,
    "THETA": 18,        # Rotation angle for command 'f'
    "ROTATE_F_LENGTH": 4.5,      # Folded side length
    "OD": 11.0,
}

params_middle = {
    "H_EXPANDED": 6.3,             # Expanded offset height
    "H_COLLAPSED": 2,
    "THETA": 14.5,        # Theta (deg)
    "ROTATE_F_LENGTH": 7.5,      # Folded side length
    "OD": 29.0,  # Outer diameter (OD)
}

params_large = {
    "H_EXPANDED": 10.0,            # Expanded offset height
    "H_COLLAPSED": 4,
    "THETA": 14.5,        # Theta (deg)
    "ROTATE_F_LENGTH": 12,     # Folded side length
    "OD": 46.0,  # Outer diameter (OD)
}


####################################
# helper
####################################

size = SIZE_CHOICE

if size == 1:
    params = params_middle
elif size == 2:
    params = params_large
else:
    params = params_small

# Global variables from chosen set
h_EXPANDED = params["H_EXPANDED"]
tHETA = params["THETA"]
oD = params["OD"]
h_FOLDED = math.sin(math.radians(tHETA) / 2) * oD *1.1

def calc_angle_replace_dist(x, dF = h_FOLDED, theta = tHETA):
    # x = num of theta (angle A = x theta)
    angle_arc_radius = dF / (2 * math.sin(theta/2))
    angle_distance = math.tan(x * theta / 2) * angle_arc_radius
    return abs(angle_distance)

'''
angle_dist_dict = {0:0}
max_num_theta = int(math.ceil(180/THETA))
for i in range(1,max_num_theta):
    distance = calc_angle_replace_dist(i, H_FOLDED, THETA)
    angle_dist_dict[i] = distance
'''

####################################
# vector operation utility 
####################################

def get_abs_cos(deg):
    return abs(math.cos(math.radians(deg)))

####################################
# deconstruct polyline & get segment lengths, fold angles, rotation angles
####################################
def project_onto_plane(v, plane_normal):
    if v.IsZero or plane_normal.IsZero:
        return rg.Vector3d.Zero
    n = rg.Vector3d(plane_normal)
    n.Unitize()
    projected = v - (v * n) * n  # Remove component along normal
    if projected.IsZero:
        return rg.Vector3d.Zero
    projected.Unitize()
    return projected

def calculate_rotation_angle2(original_vec, rotated_vec, rotation_axis):
    original_vec, rotated_vec = [project_onto_plane(v, rotation_axis) for v in [original_vec, rotated_vec]]
    if not original_vec.Length or not rotated_vec.Length: return 0
    angle = rg.Vector3d.VectorAngle(original_vec, rotated_vec)
    angle = round(math.degrees(angle))
    if rg.Vector3d.CrossProduct(original_vec, rotated_vec) * rotation_axis < 0: angle = -angle
    return angle

def calculate_rotation_angle(v1, v2, axis):
    # Project both vectors onto plane orthogonal to axis
    v1_proj = project_onto_plane(v1, axis)
    v2_proj = project_onto_plane(v2, axis)

    if v1_proj.IsZero or v2_proj.IsZero:
        return 0

    angle_rad = rg.Vector3d.VectorAngle(v1_proj, v2_proj)
    angle_deg = math.degrees(angle_rad)

    # Determine sign using cross product direction
    cross = rg.Vector3d.CrossProduct(v1_proj, v2_proj)
    if cross * axis < 0:
        angle_deg = -angle_deg

    return angle_deg

def poly2shape(p):
    r_angles = [0]
    f_angles = [0]
    lengths = [p.SegmentAt(0).Length]
    for i in range(p.SegmentCount-1):
        vi = p.SegmentAt(i).Direction
        vn = p.SegmentAt(i+1).Direction 
        projp = project_onto_plane(-p.SegmentAt(i-1).Direction, vi) if i else rg.Vector3d.XAxis
        projn = project_onto_plane(vn,vi)
        f = math.degrees(rg.Vector3d.VectorAngle(vi, vn))
        r = calculate_rotation_angle(projp,projn,vi) if f else 0
        if r < tHETA / 2: r = 0
        r_angles.append(r)
        f_angles.append(f)
        lengths.append(vn.Length)
    return lengths, r_angles, f_angles



####################################
# main operation on polyline
####################################

def vis_poly(lengths, r_angles, f_x_theta):
    
    f_angles = [math.radians(tHETA * x) for x in f_x_theta] # all convert to radians
    r_angles = [math.radians(r) for r in r_angles] # convert to radian
    pt = rg.Point3d(0, 0, 0)
    direction = rg.Vector3d.ZAxis
    up = rg.Vector3d.XAxis
    points = [pt]

    for i in range(len(lengths)):
        # Apply rotation if needed
        if i > 0:
            r = r_angles[i]
            if r != 0:
                rot = rg.Transform.Rotation(r, direction, pt)
                up.Transform(rot)

            f = f_angles[i]
            if f != 0:
                rot = rg.Transform.Rotation(f, up, pt)
                direction.Transform(rot)
        pt = pt + direction * lengths[i]
        points.append(rg.Point3d(pt))

    p_rounded = rg.Polyline(points)
    return p_rounded

def rotate_vector_to_angle(v2, v1, alpha_degrees):
    rotation_axis = rg.Vector3d.CrossProduct(v1, v2)
    rotation_axis.Unitize()
    rotated_v2 = v1.Clone()
    alpha_radians = math.radians(alpha_degrees)
    rotation_success = rotated_v2.Rotate(alpha_radians, rotation_axis)
    return rotated_v2 if rotation_success else None

def rotate_vector_around_axis(vector_to_rotate, axis_point, axis_direction, angle_degrees):
    if not axis_direction.IsUnitVector:
        axis_direction.Unitize()
    angle_radians = math.radians(angle_degrees)
    rotation = rg.Transform.Rotation(angle_radians, axis_direction, axis_point)
    rotated_vector = vector_to_rotate.Clone()
    rotated_vector.Transform(rotation)
    return rotated_vector

def construct_poly(lengths,r_angles,f_x_theta, origin = rg.Point3d(0,0,0)):
    f_angles = [tHETA * x for x in f_x_theta] # all convert to radians
    # f_angles = f_x_theta
    points = [origin]
    fold_vector = rg.Vector3d.XAxis
    vectors = [rg.Vector3d.ZAxis]

    for i,(l,r,f) in enumerate(zip(lengths,r_angles,f_angles)):
        pt = points[-1]
        vp = vectors[-1]
        vc = vp
        
        if f: vc = rotate_vector_to_angle(fold_vector,vp,f)
        if f and r: vc = rotate_vector_around_axis(vc, pt, vp, r)
        vc.Unitize()
        np = pt + vc * l
    
        points.append(np)
        vectors.append(vc)
        
        if i > 0 and f: fold_vector = project_onto_plane(-vp,vc)
            
    polyline = rg.Polyline(points)
            
    return polyline



#######################################
def shape2tube(lengths, r_angles, f_angles, pl, max_fold=MAX_FOLD, shortest_seg = 3):
    # convert to degrees
    f_x_theta = [int(round(f / tHETA)) for f in f_angles]
    X_180 = int(round(180 / tHETA)) # future work
    cmds = []
    vals = []
    new_ls = []
    new_rs = []
    new_f_x_theta = []
    # pl_rounded = vis_poly(lengths,r_angles,f_x_theta)
    pl_rounded = construct_poly(lengths, r_angles, f_x_theta)
    
    for i,(l,r,cur_x) in enumerate(zip(lengths,r_angles,f_x_theta)):

        new_l = l
        if i+1 < len(lengths): # adjust segment length based on next angle
            next_x = f_x_theta[i+1]
            next_rm_distance = calc_angle_replace_dist(next_x)
            new_l -= next_rm_distance 
            print("next remove")
            print(next_rm_distance)
        if cur_x != 0: # adjust segment length based on cur fold angle
            # this is the fold angle before cur segment
            cmds.append('r') # no need for rotation processing, directly append
            vals.append(r)
            new_rs.append(r)
            cur_rm_distance = 0
            if cur_x != X_180:
                cur_rm_distance += calc_angle_replace_dist(cur_x)
                print("cur remove")
                print(cur_rm_distance)
            if cur_x <= 4:
                cmds.append('f')
                vals.append(cur_x)

                new_rs.extend([0] * cur_x)
                new_ls.extend([h_FOLDED] * cur_x)
                new_f_x_theta.extend([1] * cur_x)
            elif cur_x <= 6:
                cmds+=['f','e','f']
                vals+=[3,1,cur_x-3]
                cur_rm_distance += h_EXPANDED

                new_rs.extend([0] * 3)
                new_ls.extend([h_FOLDED] * 3)
                new_f_x_theta.extend([1] * 3)
                new_rs.append(0)
                new_f_x_theta.append(0)
                new_ls.append(h_EXPANDED)
                new_rs.extend([0] * (cur_x-3))
                new_ls.extend([h_FOLDED] * (cur_x-3))
                new_f_x_theta.extend([1] * (cur_x-3))
            else:
                cmds+=['f','e','f']
                vals+=[4,1,cur_x-4]
                cur_rm_distance += h_EXPANDED

                new_rs.extend([0] * 4)
                new_ls.extend([h_FOLDED] * 4)
                new_f_x_theta.extend([1] * 4)
                new_rs.append(0)
                new_f_x_theta.append(0)
                new_ls.append(h_EXPANDED)
                new_rs.extend([0] * (cur_x-4))
                new_ls.extend([h_FOLDED] * (cur_x-4))
                new_f_x_theta.extend([1] * (cur_x-4))

            new_l -= cur_rm_distance
        else:
            new_rs.append(0)

        cnt = int(round(new_l/h_EXPANDED))
        if cnt < 1: # 
            cnt = 1
            new_l = 1 * h_EXPANDED
            print("Warning, segment length to short, lengthened")

        new_ls.append(new_l)
        # new_rs.append[0]
        new_f_x_theta.append(0)

        cmds.append('e')
        vals.append(cnt)

    print(new_ls, new_rs, new_f_x_theta)
    pl_tube = construct_poly(new_ls,new_rs,new_f_x_theta)
    return cmds,vals,pl_rounded,pl_tube
    

####################################
# preprocess polyline 
####################################

def combine_collinear_segments(polyline, tolerance=1e-3):
    l = len(polyline)
    if l < 3:
        return rg.Polyline(polyline)  # Nothing to simplify

    new_points = [polyline[0]]
    for i in range(1, l - 1):
        prev_pt, curr_pt, next_pt = polyline[i - 1], polyline[i], polyline[i + 1]
        v1 = curr_pt - prev_pt
        v2 = next_pt - curr_pt

        if not v1.IsZero and not v2.IsZero:
            v1.Unitize()
            v2.Unitize()
            dot = v1 * v2
            if abs(dot) < (1 - tolerance):  # Not collinear
                new_points.append(curr_pt)
    new_points.append(polyline[l-1])
    return rg.Polyline(new_points)

def process_polyline(curve, target_length, offset_z=h_EXPANDED, add_z = True):
    pl = rs.coercecurve(curve).ToPolyline()
    pl = combine_collinear_segments(pl)
    # 
    length = sum(seg.Length for seg in pl.GetSegments())
    if length == 0:
        return pl
    scale = target_length / length
    pl_scaled = rg.Polyline(pl)
    pl_scaled.Transform(rg.Transform.Scale(pl[0], scale))
    
    if add_z:
    # 2. Add vertical Z-segment
        offset_point = rg.Point3d(pl_scaled[0].X, pl_scaled[0].Y, pl_scaled[0].Z - offset_z)
        pl_shifted = rg.Polyline([offset_point] + list(pl_scaled))
        pl_shifted.Transform(rg.Transform.Translation(rg.Vector3d(0, 0, offset_z)))
    # TODO: If not add_z, rotate pl to align 1st seg with z, maybe not necessary

    return pl_shifted

####################################
# MAIN
####################################

# input x - a polyline
# input tube_len - tube length
    
# pl = rs.coercecurve(x).ToPolyline()

if CUSTOM == 1:
    print("using custom, custom values...")
    h_EXPANDED = float(h_bellow)
    tHETA = float(theta)
    oD = float(OD)
    h_FOLDED = math.sin(math.radians(tHETA) / 2) * oD *1.1
    print(h_EXPANDED)
    print(tHETA)
    print(oD)



target_length = 60 * h_EXPANDED
if isinstance(tube_len, str):
    target_length = int(tube_len) * h_EXPANDED
polyline = process_polyline(x, target_length)

lengths, r_angles, f_angles = poly2shape(polyline)

if max_fold:
    print("get max fold input")
    max_fold = int(round(max_fold))
    print(max_fold)

commands, values, pl_rounded, pl_tube = shape2tube(lengths, r_angles, f_angles,max_fold)

x = (',').join(commands)
y = (',').join(map(str,values))

translation = rg.Vector3d(20, 0, 0)
xform = rg.Transform.Translation(translation)
polyline.Transform(xform)

# vis polyline - scaled 
a = polyline
b = pl_rounded
c = pl_tube

print(x)
print(y)
# ---------- end ply_2_cmds_sss ----------
polyline_10 = PolyLine(Closed=False)
panel_4 = Panel("27.0, 4.0, 1.0, 4.0, 1.0, -180.0, 4.0, 1.0, 4.0, 11.0, -180.0, 0.0")

# ---- group: Tube Parameters
h_bellow_mm_2 = Panel("3.5")
od_mm_2 = Panel("11")
id_mm = Panel("8")
theta_deg_2 = Panel("18")
# ----
curve_interpretator = GhPythonScript(
    input_curve=curve_7,
    tube_len=tube_len_sections_4,
    max_fold=Slider(4, range=0..10),
    h_bellow=h_bellow_mm_2,
    OD=od_mm_2,
    theta=theta_deg_2)  # -> out, x, y
# ---------- curve_interpretator: Python ----------
import rhinoscriptsyntax as rs
import Rhino.Geometry as rg
import math

SIZE_CHOICE = 0 # Change as needed
MAX_FOLD = 4
CUSTOM = 1

# 0 small, 1 middle, 2 large

# Parameter sets
params_small = {
    "H_EXPANDED": 3.5,             # Offset distance for command 'e'
    "H_COLLAPSED": 1,
    "THETA": 18,        # Rotation angle for command 'f'
    "ROTATE_F_LENGTH": 4.5,      # Folded side length
    "OD": 11.0,
}

params_middle = {
    "H_EXPANDED": 6.3,             # Expanded offset height
    "H_COLLAPSED": 2,
    "THETA": 14.5,        # Theta (deg)
    "ROTATE_F_LENGTH": 7.5,      # Folded side length
    "OD": 29.0,  # Outer diameter (OD)
}

params_large = {
    "H_EXPANDED": 10.0,            # Expanded offset height
    "H_COLLAPSED": 4,
    "THETA": 14.5,        # Theta (deg)
    "ROTATE_F_LENGTH": 12,     # Folded side length
    "OD": 46.0,  # Outer diameter (OD)
}


####################################
# helper
####################################

size = SIZE_CHOICE

if size == 1:
    params = params_middle
elif size == 2:
    params = params_large
else:
    params = params_small

# Global variables from chosen set
h_EXPANDED = params["H_EXPANDED"]
tHETA = params["THETA"]
oD = params["OD"]
h_FOLDED = math.sin(math.radians(tHETA) / 2) * oD *1.1

def calc_angle_replace_dist(x, dF = h_FOLDED, theta = tHETA):
    # x = num of theta (angle A = x theta)
    angle_arc_radius = dF / (2 * math.sin(theta/2))
    angle_distance = math.tan(x * theta / 2) * angle_arc_radius
    return abs(angle_distance)

'''
angle_dist_dict = {0:0}
max_num_theta = int(math.ceil(180/THETA))
for i in range(1,max_num_theta):
    distance = calc_angle_replace_dist(i, H_FOLDED, THETA)
    angle_dist_dict[i] = distance
'''

####################################
# vector operation utility 
####################################

def get_abs_cos(deg):
    return abs(math.cos(math.radians(deg)))

####################################
# deconstruct polyline & get segment lengths, fold angles, rotation angles
####################################
def project_onto_plane(v, plane_normal):
    if v.IsZero or plane_normal.IsZero:
        return rg.Vector3d.Zero
    n = rg.Vector3d(plane_normal)
    n.Unitize()
    projected = v - (v * n) * n  # Remove component along normal
    if projected.IsZero:
        return rg.Vector3d.Zero
    projected.Unitize()
    return projected

def calculate_rotation_angle2(original_vec, rotated_vec, rotation_axis):
    original_vec, rotated_vec = [project_onto_plane(v, rotation_axis) for v in [original_vec, rotated_vec]]
    if not original_vec.Length or not rotated_vec.Length: return 0
    angle = rg.Vector3d.VectorAngle(original_vec, rotated_vec)
    angle = round(math.degrees(angle))
    if rg.Vector3d.CrossProduct(original_vec, rotated_vec) * rotation_axis < 0: angle = -angle
    return angle

def calculate_rotation_angle(v1, v2, axis):
    # Project both vectors onto plane orthogonal to axis
    v1_proj = project_onto_plane(v1, axis)
    v2_proj = project_onto_plane(v2, axis)

    if v1_proj.IsZero or v2_proj.IsZero:
        return 0

    angle_rad = rg.Vector3d.VectorAngle(v1_proj, v2_proj)
    angle_deg = math.degrees(angle_rad)

    # Determine sign using cross product direction
    cross = rg.Vector3d.CrossProduct(v1_proj, v2_proj)
    if cross * axis < 0:
        angle_deg = -angle_deg

    return angle_deg

def poly2shape(p):
    r_angles = [0]
    f_angles = [0]
    lengths = [p.SegmentAt(0).Length]
    for i in range(p.SegmentCount-1):
        vi = p.SegmentAt(i).Direction
        vn = p.SegmentAt(i+1).Direction 
        projp = project_onto_plane(-p.SegmentAt(i-1).Direction, vi) if i else rg.Vector3d.XAxis
        projn = project_onto_plane(vn,vi)
        f = math.degrees(rg.Vector3d.VectorAngle(vi, vn))
        r = calculate_rotation_angle(projp,projn,vi) if f else 0
        if r < tHETA / 2: r = 0
        r_angles.append(r)
        f_angles.append(f)
        lengths.append(vn.Length)
    return lengths, r_angles, f_angles



####################################
# main operation on polyline
####################################

def vis_poly(lengths, r_angles, f_x_theta):
    
    f_angles = [math.radians(tHETA * x) for x in f_x_theta] # all convert to radians
    r_angles = [math.radians(r) for r in r_angles] # convert to radian
    pt = rg.Point3d(0, 0, 0)
    direction = rg.Vector3d.ZAxis
    up = rg.Vector3d.XAxis
    points = [pt]

    for i in range(len(lengths)):
        # Apply rotation if needed
        if i > 0:
            r = r_angles[i]
            if r != 0:
                rot = rg.Transform.Rotation(r, direction, pt)
                up.Transform(rot)

            f = f_angles[i]
            if f != 0:
                rot = rg.Transform.Rotation(f, up, pt)
                direction.Transform(rot)
        pt = pt + direction * lengths[i]
        points.append(rg.Point3d(pt))

    p_rounded = rg.Polyline(points)
    return p_rounded

def rotate_vector_to_angle(v2, v1, alpha_degrees):
    rotation_axis = rg.Vector3d.CrossProduct(v1, v2)
    rotation_axis.Unitize()
    rotated_v2 = v1.Clone()
    alpha_radians = math.radians(alpha_degrees)
    rotation_success = rotated_v2.Rotate(alpha_radians, rotation_axis)
    return rotated_v2 if rotation_success else None

def rotate_vector_around_axis(vector_to_rotate, axis_point, axis_direction, angle_degrees):
    if not axis_direction.IsUnitVector:
        axis_direction.Unitize()
    angle_radians = math.radians(angle_degrees)
    rotation = rg.Transform.Rotation(angle_radians, axis_direction, axis_point)
    rotated_vector = vector_to_rotate.Clone()
    rotated_vector.Transform(rotation)
    return rotated_vector

def construct_poly(lengths,r_angles,f_x_theta, origin = rg.Point3d(0,0,0)):
    f_angles = [tHETA * x for x in f_x_theta] # all convert to radians
    # f_angles = f_x_theta
    points = [origin]
    fold_vector = rg.Vector3d.XAxis
    vectors = [rg.Vector3d.ZAxis]

    for i,(l,r,f) in enumerate(zip(lengths,r_angles,f_angles)):
        pt = points[-1]
        vp = vectors[-1]
        vc = vp
        
        if f: vc = rotate_vector_to_angle(fold_vector,vp,f)
        if f and r: vc = rotate_vector_around_axis(vc, pt, vp, r)
        vc.Unitize()
        np = pt + vc * l
    
        points.append(np)
        vectors.append(vc)
        
        if i > 0 and f: fold_vector = project_onto_plane(-vp,vc)
            
    polyline = rg.Polyline(points)
            
    return polyline



#######################################
def shape2tube(lengths, r_angles, f_angles, pl, max_fold=MAX_FOLD, shortest_seg = 3):
    # convert to degrees
    f_x_theta = [int(round(f / tHETA)) for f in f_angles]
    X_180 = int(round(180 / tHETA)) # future work
    cmds = []
    vals = []
    new_ls = []
    new_rs = []
    new_f_x_theta = []
    # pl_rounded = vis_poly(lengths,r_angles,f_x_theta)
    pl_rounded = construct_poly(lengths, r_angles, f_x_theta)
    
    for i,(l,r,cur_x) in enumerate(zip(lengths,r_angles,f_x_theta)):

        new_l = l
        if i+1 < len(lengths): # adjust segment length based on next angle
            next_x = f_x_theta[i+1]
            next_rm_distance = calc_angle_replace_dist(next_x)
            new_l -= next_rm_distance 
            print("next remove")
            print(next_rm_distance)
        if cur_x != 0: # adjust segment length based on cur fold angle
            # this is the fold angle before cur segment
            cmds.append('r') # no need for rotation processing, directly append
            vals.append(r)
            new_rs.append(r)
            cur_rm_distance = 0
            if cur_x != X_180:
                cur_rm_distance += calc_angle_replace_dist(cur_x)
                print("cur remove")
                print(cur_rm_distance)
            if cur_x <= 4:
                cmds.append('f')
                vals.append(cur_x)

                new_rs.extend([0] * cur_x)
                new_ls.extend([h_FOLDED] * cur_x)
                new_f_x_theta.extend([1] * cur_x)
            elif cur_x <= 6:
                cmds+=['f','e','f']
                vals+=[3,1,cur_x-3]
                cur_rm_distance += h_EXPANDED

                new_rs.extend([0] * 3)
                new_ls.extend([h_FOLDED] * 3)
                new_f_x_theta.extend([1] * 3)
                new_rs.append(0)
                new_f_x_theta.append(0)
                new_ls.append(h_EXPANDED)
                new_rs.extend([0] * (cur_x-3))
                new_ls.extend([h_FOLDED] * (cur_x-3))
                new_f_x_theta.extend([1] * (cur_x-3))
            else:
                cmds+=['f','e','f']
                vals+=[4,1,cur_x-4]
                cur_rm_distance += h_EXPANDED

                new_rs.extend([0] * 4)
                new_ls.extend([h_FOLDED] * 4)
                new_f_x_theta.extend([1] * 4)
                new_rs.append(0)
                new_f_x_theta.append(0)
                new_ls.append(h_EXPANDED)
                new_rs.extend([0] * (cur_x-4))
                new_ls.extend([h_FOLDED] * (cur_x-4))
                new_f_x_theta.extend([1] * (cur_x-4))

            new_l -= cur_rm_distance
        else:
            new_rs.append(0)

        cnt = int(round(new_l/h_EXPANDED))
        if cnt < 1: # 
            cnt = 1
            new_l = 1 * h_EXPANDED
            print("Warning, segment length to short, lengthened")

        new_ls.append(new_l)
        # new_rs.append[0]
        new_f_x_theta.append(0)

        cmds.append('e')
        vals.append(cnt)

    print(new_ls, new_rs, new_f_x_theta)
    pl_tube = construct_poly(new_ls,new_rs,new_f_x_theta)
    return cmds,vals,pl_rounded,pl_tube
    

####################################
# preprocess polyline 
####################################

def combine_collinear_segments(polyline, tolerance=1e-3):
    l = len(polyline)
    if l < 3:
        return rg.Polyline(polyline)  # Nothing to simplify

    new_points = [polyline[0]]
    for i in range(1, l - 1):
        prev_pt, curr_pt, next_pt = polyline[i - 1], polyline[i], polyline[i + 1]
        v1 = curr_pt - prev_pt
        v2 = next_pt - curr_pt

        if not v1.IsZero and not v2.IsZero:
            v1.Unitize()
            v2.Unitize()
            dot = v1 * v2
            if abs(dot) < (1 - tolerance):  # Not collinear
                new_points.append(curr_pt)
    new_points.append(polyline[l-1])
    return rg.Polyline(new_points)

def process_polyline(curve, target_length, offset_z=h_EXPANDED, add_z = True):
    pl = rs.coercecurve(curve).ToPolyline()
    pl = combine_collinear_segments(pl)
    # 
    length = sum(seg.Length for seg in pl.GetSegments())
    if length == 0:
        return pl
    scale = target_length / length
    pl_scaled = rg.Polyline(pl)
    pl_scaled.Transform(rg.Transform.Scale(pl[0], scale))
    
    if add_z:
    # 2. Add vertical Z-segment
        offset_point = rg.Point3d(pl_scaled[0].X, pl_scaled[0].Y, pl_scaled[0].Z - offset_z)
        pl_shifted = rg.Polyline([offset_point] + list(pl_scaled))
        pl_shifted.Transform(rg.Transform.Translation(rg.Vector3d(0, 0, offset_z)))
    # TODO: If not add_z, rotate pl to align 1st seg with z, maybe not necessary

    return pl_shifted

####################################
# MAIN
####################################

# input x - a polyline
# input tube_len - tube length
    
# pl = rs.coercecurve(x).ToPolyline()

if CUSTOM == 1:
    print("using custom, custom values...")
    h_EXPANDED = float(h_bellow)
    tHETA = float(theta)
    oD = float(OD)
    h_FOLDED = math.sin(math.radians(tHETA) / 2) * oD *1.1
    print(h_EXPANDED)
    print(tHETA)
    print(oD)



target_length = 60 * h_EXPANDED
if isinstance(tube_len, str):
    target_length = int(tube_len) * h_EXPANDED
    
polyline = process_polyline(input_curve, target_length)

lengths, r_angles, f_angles = poly2shape(polyline)

if max_fold:
    print("get max fold input")
    max_fold = int(round(max_fold))
    print(max_fold)

commands, values, pl_rounded, pl_tube = shape2tube(lengths, r_angles, f_angles,max_fold)

x = (',').join(commands)
y = (',').join(map(str,values))

translation = rg.Vector3d(20, 0, 0)
xform = rg.Transform.Translation(translation)
polyline.Transform(xform)
# ---------- end curve_interpretator ----------

# ---- group: cmd-val
panel_5 = Panel(curve_interpretator.y)
panel_6 = Panel(curve_interpretator.x)

panel_7 = Panel("1,4,0,1,27,0,4,1,4,11,-180,4,1,4,16,20,0,4,1,4,20,180.0,1,8,0,4,1,3,6,0,1,10,180.0,4,1,5,22,180.0,2,9,0,3,1,3,12,0,2,41,180.0,4,1,5,25,180.0,2,2,0,3,1,2,1,0,2,9,180.0,4,1,4,35")
panel_8 = Panel("e,e,r,f,e,r,f,e,f,e,r,f,e,f,e,e,r,f,e,f,e,r,f,e,r,f,e,f,e,r,f,e,r,f,e,f,e,r,f,e,r,f,e,f,e,r,f,e,r,f,e,f,e,r,f,e,r,f,e,f,e,r,f,e,r,f,e,f,e")

# ---- group: 3D Polyline To Commands & Visualization / 3D vis tube
gh_3d_cmds_to_vis = GhPythonScript(cmd="e,f,e,f,e,r,f,e,f,e,r,f", val=panel_4)  # -> out, vis; disabled
# ---------- gh_3d_cmds_to_vis: Python ----------
import rhinoscriptsyntax as rs
import Rhino.Geometry as rg
import math
import json
import random


def FunctionE(plane):
    # print("function A called")
    r = offset_plane(plane, 3.6)
    return r
    
def FunctionF(plane):
    # print("function A called")
    # r = offset_plane(plane, 0.5)
    r = plane
    r = rotate_plane(r, 20)
    r = offset_plane(r, 2.48)
    return r

def FunctionR(plane, angle):
    
    print(angle)
    angle = math.radians(angle)
    

    # Rotate the plane around its normal
    # The rotation axis is the plane's normal, and the rotation is performed about the plane's origin
    r = plane.Clone()  # Clone the original plane to keep it unchanged
    
    # print("raw")
    # print(r.XAxis,r.YAxis,r.ZAxis)
    
    x_old = r.XAxis
    y_old = r.YAxis
    
    axis = r.Normal
    
    r.Rotate(angle, axis, r.Origin)
    
    # print("rotated")
    # print(r.XAxis,r.YAxis,r.ZAxis)
    
    angle_x = calculate_rotation_angle(x_old, r.XAxis, plane.Normal)
    angle_y = calculate_rotation_angle(y_old, r.YAxis, plane.Normal)
    
    print(angle_x, angle_y)

    return r

def project_onto_plane(v, plane_normal):
    plane_normal.Unitize()  # Ensure the normal is a unit vector
    dot_product = rg.Vector3d.Multiply(v, plane_normal)
    projection = v - (dot_product * plane_normal)
    return projection
    
def calculate_rotation_angle(v1, v2, rotation_axis):
    
    v1 = project_onto_plane(v1, rotation_axis)
    v2 = project_onto_plane(v2, rotation_axis)
    
    # Calculate the angle between the original and rotated vectors
    dot_product = rg.Vector3d.Multiply(v1, v2)
    magnitude_product = v1.Length * v2.Length
    
    if abs(magnitude_product) >= 1:
        magnitude_product = magnitude_product / abs(magnitude_product)
    
    cos_num = dot_product / magnitude_product
    
    if abs(cos_num) > 1:
        print("cos",cos_num)
        cos_num = round(cos_num)
        
    angle_radians = math.acos(cos_num)
    
    
    # Convert radians to degrees
    angle_degrees = math.degrees(angle_radians)
    
    # Determine the direction of rotation
    cross_product = rg.Vector3d.CrossProduct(v1, v2)
    direction = rg.Vector3d.Multiply(cross_product, rotation_axis)
    
    # If the direction is negative, adjust the angle to reflect the opposite rotation
    if direction < 0:
        angle_degrees = -angle_degrees
    
    return round(angle_degrees)
    
def offset_plane(plane, offset_distance):
    """
    Offsets the given plane along its normal by the specified offset_distance.
    """
    new_plane = rg.Plane(plane)
    translation_vector = plane.Normal * offset_distance
    new_plane.Translate(translation_vector)
    return new_plane
    
def rotate_plane(input_plane, angle_degrees):
    """
    Rotates the given plane around its origin about its Y-axis by the specified angle (in degrees).
    """
    angle_radians = math.radians(angle_degrees)
    # Create a rotation transformation around the plane's origin using its Y-axis
    rotation = rg.Transform.Rotation(angle_radians, input_plane.YAxis, input_plane.Origin)
    
    # Clone the X and Y axes and apply the rotation
    rotated_x_axis = rg.Vector3d(input_plane.XAxis)
    rotated_y_axis = rg.Vector3d(input_plane.YAxis)
    rotated_x_axis.Transform(rotation)
    rotated_y_axis.Transform(rotation)
    
    rotated_plane = rg.Plane(input_plane.Origin, rotated_x_axis, rotated_y_axis)
    return rotated_plane

def GeneratePlanes(cmd_arr, val_arr):
    planes = []
    planes.append(rg.Plane.WorldXY)
    
    tmp_plane = None
    
    for _, (cmd, val) in enumerate(zip(cmd_arr, val_arr)):
                
        if cmd == 'r' and val != 0:
            plane = planes[-1]
            plane = FunctionR(plane, val) # rotate the current plane by an angle
            planes[-1] = plane
        else: 
            for _ in range(int(val)):
                plane = planes[-1]
                new_plane = FunctionF(plane) if cmd == 'f' else FunctionE(plane) # e or f
                planes.append(new_plane)
    
    return planes

    
def createCircles(group, diameter):

    # Empty list to store circle surfaces
    curve_edges = []

    # Loop through each plane in the list
    for plane in group:
        # Create a circle at the plane's origin with the specified diameter
        circle = rg.Circle(plane, diameter / 2)
        
        # Convert the circle into a circle surface
        # circle_surface = rg.Surface.CreateExtrusion(circle.ToNurbsCurve(), plane.Normal * 0.1)  # Adjust the extrusion distance as needed
        
        # Append the circle surface to the list
        curve = circle.ToNurbsCurve()
        curve_edges.append(curve)

    # Output the list of circle surfaces
    return curve_edges
 
 
def createMidPlanes(planes):
    
    length = len(planes)
    mid_planes=[]
    
    for i in range(length-1):
 
        plane1 = planes[i]
        plane2 = planes[i+1]
        
        mid_point = (plane1.Origin + plane2.Origin) / 2

        # Interpolate the X, Y, and Z axes
        mid_x = (plane1.XAxis + plane2.XAxis) / 2
        
        if mid_x.Length == 0:
            print(i)
            print("planes x are opposite 180 deg")
            mid_x = plane2.XAxis
            
        mid_y = (plane1.YAxis + plane2.YAxis) / 2
        
        if mid_y.Length == 0:
            print(i)
            mid_y = plane2.YAxis
            print("planes y are opposite 180 deg")
        

        # Normalize the axes
        mid_x.Unitize()
        mid_y.Unitize()

        # Create the mid-plane
        mid_plane = rg.Plane(mid_point, mid_x, mid_y)
        if mid_plane == None:
            mid_plane = offset_plane(plane1, 1.5)
        mid_planes.append(mid_plane)

    return mid_planes

def parseInput(x, y):
    # Parse command sequence
    x = x.replace("\n", "").replace("\r", "")
    y = y.replace("\n", "").replace("\r", "")

    if isinstance(x, str):
        x = [i for i in x.split(',')]
    # Ensure the sequence list contains only 0s and 1s
        # Parse value sequence
    if isinstance(y, str):
        y = [float(i) for i in y.split(',')]
        
    # Trim array
    trim_len = min(len(x), len(y))
    x = x[:trim_len]
    y = y[:trim_len]

    # Check if sequences are valid
    valid_sequence = (trim_len >= 2)
    valid_sequence &= all(i == 'e' or i=='r' or i == 'f' for i in x)
    # valid_sequence &= all(i >= 0 for i in y)
    
    if valid_sequence:
        print("Valid Input")
        print(x)
        print(y)
    else:
        # Handle invalid input
        print("Invalid input.")
        print("Please provide'e','r','f' for commands.")
        print("Please provide nonnegative count or angle for value")
        print("Generating random values for testing...")
        # x,y = genRandom(x,y)
        
        print((x,y))
        
    return (x,y)

def get_random_char(ex=None):
    characters = ['e', 'r', 'f']
    if ex:
        characters.remove(ex)
    return random.choice(characters)
    
def genRandom():
    x = []
    y = []
    repeat = 0
    prev = ''
    i = 0
    while i < 50:
        
        tmp = get_random_char(ex=prev)
        
        x.append(tmp)
        
        if tmp == 'r':
            y.append(random.randint(-180,180))
        elif tmp == 'e':
            step = random.randint(1,6)
            y.append(step)
            i += step
        else:
            step = random.randint(1,3)
            y.append(step)
            i += step
        prev = tmp
        

    return (x,y)



cmd_arr, val_arr = parseInput(cmd,val)



planes = GeneratePlanes(cmd_arr, val_arr)

# Create a Group to store all the planes

midplanes= createMidPlanes(planes)
 
    
# Output the resulting group of planes
main = createCircles(planes,11) # original 11
mid = createCircles(midplanes, 8)

a = [val for pair in zip(main, mid) for val in pair]
a.append(main[-1])

vis = a
# ---------- end gh_3d_cmds_to_vis ----------
cluster = Cluster()
loft = Loft(Curves=gh_3d_cmds_to_vis.vis, Options=cluster)
cap_holes_ex = CapHolesEx(Brep=loft)  # -> Brep, Caps, Solid

# ---- group: cmd-val
panel_9 = Panel(ply_2_cmds.x)
panel_10 = Panel(ply_2_cmds.y)

panel_11 = Panel(ply_2_cmds_lll.x)
panel_12 = Panel(ply_2_cmds_lll.y)

panel_13 = Panel(ply_2_cmds_sss.y)
panel_14 = Panel(ply_2_cmds_sss.x)

# ---- group: Tube Visualizer
tube_visualizer = GhPythonScript(cmd=panel_8, val=panel_7, OD=od_mm_2, ID=id_mm, theta=theta_deg_2, h_bellow=h_bellow_mm_2)  # -> out, vis; disabled
# ---------- tube_visualizer: Python ----------
import rhinoscriptsyntax as rs
import Rhino.Geometry as rg
import math

# ============================
# Global Configuration
# ============================
SIZE_CHOICE = 0 # 0=small, 1=middle, 2=large
CUSTOM = 1

params_small = {
    "H_EXPANDED": 3.5,             # Offset distance for command 'e'
    "H_COLLAPSED": 1,
    "THETA": 18,        # Rotation angle for command 'f'
    "ROTATE_F_LENGTH": 4.5,      # Folded side length
    "OD": 11.0,
    "ID": 8.0,
}

params_middle = {
    "H_EXPANDED": 6.3,             # Expanded offset height
    "H_COLLAPSED": 2,
    "THETA": 14.5,        # Theta (deg)
    "ROTATE_F_LENGTH": 7.5,      # Folded side length
    "OD": 29.0,  # Outer diameter (OD)
    "ID": 23.0,
}

params_large = {
    "H_EXPANDED": 10.0,            # Expanded offset height
    "H_COLLAPSED": 4,
    "THETA": 14.5,        # Theta (deg)
    "ROTATE_F_LENGTH": 12,     # Folded side length
    "OD": 46.0,  # Outer diameter (OD)
    "ID": 35.0,
}
size = SIZE_CHOICE

if size == 1:
    params = params_middle
elif size == 2:
    params = params_large
else:
    params = params_small
# Global variables from chosen set
h_EXPANDED = params["H_EXPANDED"]
tHETA = params["THETA"]
oD = params["OD"]
iD = params["ID"]
h_FOLDED = math.sin(math.radians(tHETA) / 2) * oD * 1.1

# ============================
# Geometry Functions
# ============================

def offset_plane(plane, d): # offset plane along normal by d
    new_plane = rg.Plane(plane)
    new_plane.Translate(plane.Normal * d)
    return new_plane

def create_translation_vector(plane): # rotated normal * length
    angle = -math.radians(tHETA) / 2
    rot = rg.Transform.Rotation(angle, plane.YAxis, plane.Origin)
    vec = rg.Vector3d(plane.Normal); vec.Transform(rot); vec.Unitize()
    return vec * h_FOLDED 

def rotate_plane_byY(plane, deg): # rotate around Y-axis
    rad = math.radians(deg)
    rot = rg.Transform.Rotation(rad, plane.YAxis, plane.Origin)
    x = rg.Vector3d(plane.XAxis); y = rg.Vector3d(plane.YAxis)
    x.Transform(rot); y.Transform(rot)
    return rg.Plane(plane.Origin, x, y)

# ============================
# Command Transformations
# ============================

def function_e(plane): return offset_plane(plane, h_EXPANDED) # 'e' command

def function_f(plane): # 'f' command
    plane = rotate_plane_byY(plane, tHETA)
    plane.Translate(create_translation_vector(plane))
    return plane

def function_r(plane, angle): # 'r' command
    rad = math.radians(angle)
    new_plane = plane.Clone()
    new_plane.Rotate(rad, new_plane.Normal, new_plane.Origin)
    return new_plane


def generate_planes(cmds, vals, start_plane):
    planes = [start_plane]
    for cmd, val in zip(cmds, vals):
        if cmd == 'r' and val != 0:
            planes[-1] = function_r(planes[-1], val)
        else:
            for _ in range(int(val)):
                planes.append(function_f(planes[-1]) if cmd == 'f' else function_e(planes[-1]))
    return planes



# ============================
# Visualization Helpers
# ============================

def create_circles1(planes, dia): # create circles on planes
    return [rg.Circle(p, dia / 2).ToNurbsCurve() for p in planes]

def create_circles(planes, diameter):
    curves = []
    for plane in planes:
        circle = rg.Circle(plane, diameter / 2.0)

        # Sample 8 points on the circle at even angles (fixed seam and structure)
        points = []
        for i in range(8):
            angle = math.radians(i * 45.0)
            x = math.cos(angle) * circle.Radius
            y = math.sin(angle) * circle.Radius
            pt = plane.PointAt(x, y)
            points.append(pt)

        points.append(points[0])  # Close the circle
        polycurve = rg.Curve.CreateInterpolatedCurve(points, 3, rg.CurveKnotStyle.Uniform)
        curves.append(polycurve)
    return curves


def create_circles_with_seam_tracking(planes, diameter):
    curves = []
    prev_tangent_point = None

    for i, plane in enumerate(planes):
        circle = rg.Circle(plane, diameter / 2.0)
        nurbs = circle.ToNurbsCurve()

        # Use initial seam aligned to first plane's XAxis
        if i == 0:
            seam_target = plane.Origin + plane.XAxis
        else:
            seam_target = prev_tangent_point

        success, t = nurbs.ClosestPoint(seam_target)
        if success:
            nurbs.ChangeClosedCurveSeam(t)

        # Store a point tangent to current circle XAxis for next seam alignment
        prev_tangent_point = plane.Origin + plane.XAxis

        curves.append(nurbs)

    return curves

def create_mid_planes2(planes): # average between planes
    mids = []
    for i in range(len(planes) - 1):
        p1, p2 = planes[i], planes[i + 1]
        mid_pt = (p1.Origin + p2.Origin) / 2
        x, y = p1.XAxis + p2.XAxis, p1.YAxis + p2.YAxis
        if x.Length == 0: print("Warning: X axes opposite", i); x = p2.XAxis
        if y.Length == 0: print("Warning: Y axes opposite", i); y = p2.YAxis
        x.Unitize(); y.Unitize()
        mids.append(rg.Plane(mid_pt, x, y) or offset_plane(p1, 1.5))
    return mids
    
def create_mid_planes(planes):
    mids = []
    for i in range(len(planes) - 1):
        p1, p2 = planes[i], planes[i + 1]
        mid_pt = (p1.Origin + p2.Origin) / 2

        x1, x2 = p1.XAxis, p2.XAxis
        y1, y2 = p1.YAxis, p2.YAxis

        # Flip if necessary to keep directions consistent
        if x1 * x2 < 0: x2 *= -1
        if y1 * y2 < 0: y2 *= -1

        mid_x = x1 + x2
        mid_y = y1 + y2
        mid_x.Unitize(); mid_y.Unitize()

        try:
            mids.append(rg.Plane(mid_pt, mid_x, mid_y))
        except:
            mids.append(offset_plane(p1, 1.5))
    return mids


# ============================
# Input Parsing
# ============================

def parseInput(x, y):
    x = x.replace("\n", "").replace("\r", "")
    y = y.replace("\n", "").replace("\r", "")
    if isinstance(x, str): x = x.split(',')
    if isinstance(y, str): y = [float(i) for i in y.split(',')]
    n = min(len(x), len(y))
    x, y = x[:n], y[:n]
    valid = n >= 2 and all(i in ('e', 'r', 'f') for i in x)
    return x, y

# ============================
# Main Execution
# ============================


if CUSTOM == 1:
    print("using custom, custom values...")
    h_EXPANDED = float(h_bellow)
    tHETA = float(theta)
    oD = float(OD)
    iD = float(ID)
    h_FOLDED = math.sin(math.radians(tHETA) / 2) * oD *1.1
    print(h_EXPANDED)
    print(tHETA)
    print(oD)

cmd_arr, val_arr = parseInput(cmd, val)
first_plane = rg.Plane.WorldXY

'''
if isinstance(origin, str): # override origin if provided
    origin = origin.replace("\n", "").replace("\r", "")
    x, y, z = [float(i) for i in origin.split(',')[:3]]
    pt = rg.Point3d(x, y, z)
    first_plane = rg.Plane(pt, rg.Vector3d(1, 0, 0), rg.Vector3d(0, 1, 0))
'''

planes = generate_planes(cmd_arr, val_arr, first_plane)
mid_planes = create_mid_planes(planes)

debug_vectors = []
for p in planes:
    origin = p.Origin
    x_axis = p.XAxis
    line = rg.Line(origin, origin + x_axis * 5)
    debug_vectors.append(line)

#main_curves = create_circles(planes, D)
#mid_curves = create_circles(mid_planes, ID)

main_curves = create_circles_with_seam_tracking(planes, oD)
#mid_curves = create_circles_with_seam_tracking(mid_planes, ID)
mid_curves = create_circles(mid_planes, iD)

visualization_curves = [c for pair in zip(main_curves, mid_curves) for c in pair]
visualization_curves.append(main_curves[-1]) # add final curve

vis = visualization_curves # output for Grasshopper
# ---------- end tube_visualizer ----------
loft_2 = Loft(
    Curves=tube_visualizer.vis,
    Options={Adjust=False, Closed=False, LoftEnds=0, LoftSimp=0, LoftType=0, Rebuild=10, Refit=0.01})
cap_holes_ex_2 = CapHolesEx(Brep=loft_2)  # -> Brep, Caps, Solid

# ---- group: Vis S
cmd2vis_sss = GhPythonScript(origin="-40,0,0", cmd=panel_14, val=panel_13)  # -> out, vis
# ---------- cmd2vis_sss: Python ----------
import rhinoscriptsyntax as rs
import Rhino.Geometry as rg
import math

# ============================
# Global Configuration
# ============================
SIZE_CHOICE = 0 # 0=small, 1=middle, 2=large

params_small = {
    "H_EXPANDED": 3.5,             # Offset distance for command 'e'
    "H_COLLAPSED": 1,
    "THETA": 18,        # Rotation angle for command 'f'
    "ROTATE_F_LENGTH": 4.5,      # Folded side length
    "OD": 11.0,
    "ID": 8.0,
}

params_middle = {
    "H_EXPANDED": 6.3,             # Expanded offset height
    "H_COLLAPSED": 2,
    "THETA": 14.5,        # Theta (deg)
    "ROTATE_F_LENGTH": 7.5,      # Folded side length
    "OD": 29.0,  # Outer diameter (OD)
    "ID": 23.0,
}

params_large = {
    "H_EXPANDED": 10.0,            # Expanded offset height
    "H_COLLAPSED": 4,
    "THETA": 14.5,        # Theta (deg)
    "ROTATE_F_LENGTH": 12,     # Folded side length
    "OD": 46.0,  # Outer diameter (OD)
    "ID": 35.0,
}
size = SIZE_CHOICE

if size == 1:
    params = params_middle
elif size == 2:
    params = params_large
else:
    params = params_small
# Global variables from chosen set
H_EXPANDED = params["H_EXPANDED"]
THETA = params["THETA"]
OD = params["OD"]
ID = params["ID"]
H_FOLDED = math.sin(math.radians(THETA) / 2) * OD * 1.1
print(H_FOLDED)

# ============================
# Geometry Functions
# ============================

def offset_plane(plane, d): # offset plane along normal by d
    new_plane = rg.Plane(plane)
    new_plane.Translate(plane.Normal * d)
    return new_plane

def create_translation_vector(plane): # rotated normal * length
    angle = -math.radians(THETA) / 2
    rot = rg.Transform.Rotation(angle, plane.YAxis, plane.Origin)
    vec = rg.Vector3d(plane.Normal); vec.Transform(rot); vec.Unitize()
    return vec * H_FOLDED 

def rotate_plane_byY(plane, deg): # rotate around Y-axis
    rad = math.radians(deg)
    rot = rg.Transform.Rotation(rad, plane.YAxis, plane.Origin)
    x = rg.Vector3d(plane.XAxis); y = rg.Vector3d(plane.YAxis)
    x.Transform(rot); y.Transform(rot)
    return rg.Plane(plane.Origin, x, y)

# ============================
# Command Transformations
# ============================

def function_e(plane): return offset_plane(plane, H_EXPANDED) # 'e' command

def function_f(plane): # 'f' command
    plane = rotate_plane_byY(plane, THETA)
    plane.Translate(create_translation_vector(plane))
    return plane

def function_r(plane, angle): # 'r' command
    rad = math.radians(angle)
    new_plane = plane.Clone()
    new_plane.Rotate(rad, new_plane.Normal, new_plane.Origin)
    return new_plane


def generate_planes(cmds, vals, start_plane):
    planes = [start_plane]
    for cmd, val in zip(cmds, vals):
        if cmd == 'r' and val != 0:
            planes[-1] = function_r(planes[-1], val)
        else:
            for _ in range(int(val)):
                planes.append(function_f(planes[-1]) if cmd == 'f' else function_e(planes[-1]))
    return planes



# ============================
# Visualization Helpers
# ============================

def create_circles1(planes, dia): # create circles on planes
    return [rg.Circle(p, dia / 2).ToNurbsCurve() for p in planes]

def create_circles(planes, diameter):
    curves = []
    for plane in planes:
        circle = rg.Circle(plane, diameter / 2.0)

        # Sample 8 points on the circle at even angles (fixed seam and structure)
        points = []
        for i in range(8):
            angle = math.radians(i * 45.0)
            x = math.cos(angle) * circle.Radius
            y = math.sin(angle) * circle.Radius
            pt = plane.PointAt(x, y)
            points.append(pt)

        points.append(points[0])  # Close the circle
        polycurve = rg.Curve.CreateInterpolatedCurve(points, 3, rg.CurveKnotStyle.Uniform)
        curves.append(polycurve)
    return curves


def create_circles_with_seam_tracking(planes, diameter):
    curves = []
    prev_tangent_point = None

    for i, plane in enumerate(planes):
        circle = rg.Circle(plane, diameter / 2.0)
        nurbs = circle.ToNurbsCurve()

        # Use initial seam aligned to first plane's XAxis
        if i == 0:
            seam_target = plane.Origin + plane.XAxis
        else:
            seam_target = prev_tangent_point

        success, t = nurbs.ClosestPoint(seam_target)
        if success:
            nurbs.ChangeClosedCurveSeam(t)

        # Store a point tangent to current circle XAxis for next seam alignment
        prev_tangent_point = plane.Origin + plane.XAxis

        curves.append(nurbs)

    return curves

def create_mid_planes2(planes): # average between planes
    mids = []
    for i in range(len(planes) - 1):
        p1, p2 = planes[i], planes[i + 1]
        mid_pt = (p1.Origin + p2.Origin) / 2
        x, y = p1.XAxis + p2.XAxis, p1.YAxis + p2.YAxis
        if x.Length == 0: print("Warning: X axes opposite", i); x = p2.XAxis
        if y.Length == 0: print("Warning: Y axes opposite", i); y = p2.YAxis
        x.Unitize(); y.Unitize()
        mids.append(rg.Plane(mid_pt, x, y) or offset_plane(p1, 1.5))
    return mids
    
def create_mid_planes(planes):
    mids = []
    for i in range(len(planes) - 1):
        p1, p2 = planes[i], planes[i + 1]
        mid_pt = (p1.Origin + p2.Origin) / 2

        x1, x2 = p1.XAxis, p2.XAxis
        y1, y2 = p1.YAxis, p2.YAxis

        # Flip if necessary to keep directions consistent
        if x1 * x2 < 0: x2 *= -1
        if y1 * y2 < 0: y2 *= -1

        mid_x = x1 + x2
        mid_y = y1 + y2
        mid_x.Unitize(); mid_y.Unitize()

        try:
            mids.append(rg.Plane(mid_pt, mid_x, mid_y))
        except:
            mids.append(offset_plane(p1, 1.5))
    return mids


# ============================
# Input Parsing
# ============================

def parseInput(x, y):
    x = x.replace("\n", "").replace("\r", "")
    y = y.replace("\n", "").replace("\r", "")
    if isinstance(x, str): x = x.split(',')
    if isinstance(y, str): y = [float(i) for i in y.split(',')]
    n = min(len(x), len(y))
    x, y = x[:n], y[:n]
    valid = n >= 2 and all(i in ('e', 'r', 'f') for i in x)
    return x, y

# ============================
# Main Execution
# ============================


cmd_arr, val_arr = parseInput(cmd, val)
first_plane = rg.Plane.WorldXY

if isinstance(origin, str): # override origin if provided
    origin = origin.replace("\n", "").replace("\r", "")
    x, y, z = [float(i) for i in origin.split(',')[:3]]
    pt = rg.Point3d(x, y, z)
    first_plane = rg.Plane(pt, rg.Vector3d(1, 0, 0), rg.Vector3d(0, 1, 0))

planes = generate_planes(cmd_arr, val_arr, first_plane)
mid_planes = create_mid_planes(planes)

debug_vectors = []
for p in planes:
    origin = p.Origin
    x_axis = p.XAxis
    line = rg.Line(origin, origin + x_axis * 5)
    debug_vectors.append(line)

#main_curves = create_circles(planes, D)
#mid_curves = create_circles(mid_planes, ID)

main_curves = create_circles_with_seam_tracking(planes, OD)
#mid_curves = create_circles_with_seam_tracking(mid_planes, ID)
mid_curves = create_circles(mid_planes, ID)

visualization_curves = [c for pair in zip(main_curves, mid_curves) for c in pair]
visualization_curves.append(main_curves[-1]) # add final curve

vis = visualization_curves # output for Grasshopper
# ---------- end cmd2vis_sss ----------
loft_3 = Loft(Curves=cmd2vis_sss.vis, Options={Adjust=False, Closed=False, LoftEnds=0, LoftSimp=0, LoftType=0, Rebuild=10, Refit=0.01})
cap_holes_ex_3 = CapHolesEx(Brep=loft_3)  # -> Brep, Caps, Solid

# ---- group: Vis M
cmd2vis_mmm = GhPythonScript(origin="100,0,0", cmd=panel_9, val=panel_10)  # -> out, vis
# ---------- cmd2vis_mmm: Python ----------
import rhinoscriptsyntax as rs
import Rhino.Geometry as rg
import math

# ============================
# Global Configuration
# ============================
SIZE_CHOICE = 1 # 0=small, 1=middle, 2=large

params_small = {
    "H_EXPANDED": 3.5,             # Offset distance for command 'e'
    "H_COLLAPSED": 1,
    "THETA": 18,        # Rotation angle for command 'f'
    "ROTATE_F_LENGTH": 4.5,      # Folded side length
    "OD": 11.0,
    "ID": 8.0,
}

params_middle = {
    "H_EXPANDED": 6.3,             # Expanded offset height
    "H_COLLAPSED": 2,
    "THETA": 14.5,        # Theta (deg)
    "ROTATE_F_LENGTH": 7.5,      # Folded side length
    "OD": 29.0,  # Outer diameter (OD)
    "ID": 23.0,
}

params_large = {
    "H_EXPANDED": 10.0,            # Expanded offset height
    "H_COLLAPSED": 4,
    "THETA": 14.5,        # Theta (deg)
    "ROTATE_F_LENGTH": 12,     # Folded side length
    "OD": 46.0,  # Outer diameter (OD)
    "ID": 35.0,
}
size = SIZE_CHOICE

if size == 1:
    params = params_middle
elif size == 2:
    params = params_large
else:
    params = params_small
# Global variables from chosen set
H_EXPANDED = params["H_EXPANDED"]
THETA = params["THETA"]
OD = params["OD"]
ID = params["ID"]
H_FOLDED = math.sin(math.radians(THETA) / 2) * OD * 1.1
print(H_FOLDED)

# ============================
# Geometry Functions
# ============================

def offset_plane(plane, d): # offset plane along normal by d
    new_plane = rg.Plane(plane)
    new_plane.Translate(plane.Normal * d)
    return new_plane

def create_translation_vector(plane): # rotated normal * length
    angle = -math.radians(THETA) / 2
    rot = rg.Transform.Rotation(angle, plane.YAxis, plane.Origin)
    vec = rg.Vector3d(plane.Normal); vec.Transform(rot); vec.Unitize()
    return vec * H_FOLDED 

def rotate_plane_byY(plane, deg): # rotate around Y-axis
    rad = math.radians(deg)
    rot = rg.Transform.Rotation(rad, plane.YAxis, plane.Origin)
    x = rg.Vector3d(plane.XAxis); y = rg.Vector3d(plane.YAxis)
    x.Transform(rot); y.Transform(rot)
    return rg.Plane(plane.Origin, x, y)

# ============================
# Command Transformations
# ============================

def function_e(plane): return offset_plane(plane, H_EXPANDED) # 'e' command

def function_f(plane): # 'f' command
    plane = rotate_plane_byY(plane, THETA)
    plane.Translate(create_translation_vector(plane))
    return plane

def function_r(plane, angle): # 'r' command
    rad = math.radians(angle)
    new_plane = plane.Clone()
    new_plane.Rotate(rad, new_plane.Normal, new_plane.Origin)
    return new_plane


def generate_planes(cmds, vals, start_plane):
    planes = [start_plane]
    for cmd, val in zip(cmds, vals):
        if cmd == 'r' and val != 0:
            planes[-1] = function_r(planes[-1], val)
        else:
            for _ in range(int(val)):
                planes.append(function_f(planes[-1]) if cmd == 'f' else function_e(planes[-1]))
    return planes



# ============================
# Visualization Helpers
# ============================

def create_circles1(planes, dia): # create circles on planes
    return [rg.Circle(p, dia / 2).ToNurbsCurve() for p in planes]

def create_circles(planes, diameter):
    curves = []
    for plane in planes:
        circle = rg.Circle(plane, diameter / 2.0)

        # Sample 8 points on the circle at even angles (fixed seam and structure)
        points = []
        for i in range(8):
            angle = math.radians(i * 45.0)
            x = math.cos(angle) * circle.Radius
            y = math.sin(angle) * circle.Radius
            pt = plane.PointAt(x, y)
            points.append(pt)

        points.append(points[0])  # Close the circle
        polycurve = rg.Curve.CreateInterpolatedCurve(points, 3, rg.CurveKnotStyle.Uniform)
        curves.append(polycurve)
    return curves


def create_circles_with_seam_tracking(planes, diameter):
    curves = []
    prev_tangent_point = None

    for i, plane in enumerate(planes):
        circle = rg.Circle(plane, diameter / 2.0)
        nurbs = circle.ToNurbsCurve()

        # Use initial seam aligned to first plane's XAxis
        if i == 0:
            seam_target = plane.Origin + plane.XAxis
        else:
            seam_target = prev_tangent_point

        success, t = nurbs.ClosestPoint(seam_target)
        if success:
            nurbs.ChangeClosedCurveSeam(t)

        # Store a point tangent to current circle XAxis for next seam alignment
        prev_tangent_point = plane.Origin + plane.XAxis

        curves.append(nurbs)

    return curves

def create_mid_planes2(planes): # average between planes
    mids = []
    for i in range(len(planes) - 1):
        p1, p2 = planes[i], planes[i + 1]
        mid_pt = (p1.Origin + p2.Origin) / 2
        x, y = p1.XAxis + p2.XAxis, p1.YAxis + p2.YAxis
        if x.Length == 0: print("Warning: X axes opposite", i); x = p2.XAxis
        if y.Length == 0: print("Warning: Y axes opposite", i); y = p2.YAxis
        x.Unitize(); y.Unitize()
        mids.append(rg.Plane(mid_pt, x, y) or offset_plane(p1, 1.5))
    return mids
    
def create_mid_planes(planes):
    mids = []
    for i in range(len(planes) - 1):
        p1, p2 = planes[i], planes[i + 1]
        mid_pt = (p1.Origin + p2.Origin) / 2

        x1, x2 = p1.XAxis, p2.XAxis
        y1, y2 = p1.YAxis, p2.YAxis

        # Flip if necessary to keep directions consistent
        if x1 * x2 < 0: x2 *= -1
        if y1 * y2 < 0: y2 *= -1

        mid_x = x1 + x2
        mid_y = y1 + y2
        mid_x.Unitize(); mid_y.Unitize()

        try:
            mids.append(rg.Plane(mid_pt, mid_x, mid_y))
        except:
            mids.append(offset_plane(p1, 1.5))
    return mids


# ============================
# Input Parsing
# ============================

def parseInput(x, y):
    x = x.replace("\n", "").replace("\r", "")
    y = y.replace("\n", "").replace("\r", "")
    if isinstance(x, str): x = x.split(',')
    if isinstance(y, str): y = [float(i) for i in y.split(',')]
    n = min(len(x), len(y))
    x, y = x[:n], y[:n]
    valid = n >= 2 and all(i in ('e', 'r', 'f') for i in x)
    return x, y

# ============================
# Main Execution
# ============================


cmd_arr, val_arr = parseInput(cmd, val)
first_plane = rg.Plane.WorldXY

if isinstance(origin, str): # override origin if provided
    origin = origin.replace("\n", "").replace("\r", "")
    x, y, z = [float(i) for i in origin.split(',')[:3]]
    pt = rg.Point3d(x, y, z)
    first_plane = rg.Plane(pt, rg.Vector3d(1, 0, 0), rg.Vector3d(0, 1, 0))

planes = generate_planes(cmd_arr, val_arr, first_plane)
mid_planes = create_mid_planes(planes)

debug_vectors = []
for p in planes:
    origin = p.Origin
    x_axis = p.XAxis
    line = rg.Line(origin, origin + x_axis * 5)
    debug_vectors.append(line)

#main_curves = create_circles(planes, D)
#mid_curves = create_circles(mid_planes, ID)

main_curves = create_circles_with_seam_tracking(planes, OD)
#mid_curves = create_circles_with_seam_tracking(mid_planes, ID)
mid_curves = create_circles(mid_planes, ID)

visualization_curves = [c for pair in zip(main_curves, mid_curves) for c in pair]
visualization_curves.append(main_curves[-1]) # add final curve

vis = visualization_curves # output for Grasshopper
# ---------- end cmd2vis_mmm ----------
loft_4 = Loft(Curves=cmd2vis_mmm.vis, Options={Adjust=False, Closed=False, LoftEnds=0, LoftSimp=0, LoftType=0, Rebuild=10, Refit=0.01})
cap_holes_ex_4 = CapHolesEx(Brep=loft_4)  # -> Brep, Caps, Solid

# ---- group: Before - S tube
h_bellow_mm_3 = Panel("3.5")
od_mm_3 = Panel("11")
id_mm_2 = Panel("8")
theta_deg_3 = Panel("18")

# ---- group: After - L tube
h_bellow_mm_4 = Panel("10")
od_mm_4 = Panel("46")
id_mm_3 = Panel("35")
theta_deg_4 = Panel("14.5")

# ---- group: Vis L
cmd2vis_lll = GhPythonScript(origin="300,0,0", cmd=panel_11, val=panel_12)  # -> out, vis
# ---------- cmd2vis_lll: Python ----------
import rhinoscriptsyntax as rs
import Rhino.Geometry as rg
import math

# ============================
# Global Configuration
# ============================
SIZE_CHOICE = 2 # 0=small, 1=middle, 2=large

params_small = {
    "H_EXPANDED": 3.5,             # Offset distance for command 'e'
    "H_COLLAPSED": 1,
    "THETA": 18,        # Rotation angle for command 'f'
    "ROTATE_F_LENGTH": 4.5,      # Folded side length
    "OD": 11.0,
    "ID": 8.0,
}

params_middle = {
    "H_EXPANDED": 6.3,             # Expanded offset height
    "H_COLLAPSED": 2,
    "THETA": 14.5,        # Theta (deg)
    "ROTATE_F_LENGTH": 7.5,      # Folded side length
    "OD": 29.0,  # Outer diameter (OD)
    "ID": 23.0,
}

params_large = {
    "H_EXPANDED": 10.0,            # Expanded offset height
    "H_COLLAPSED": 4,
    "THETA": 14.5,        # Theta (deg)
    "ROTATE_F_LENGTH": 12,     # Folded side length
    "OD": 46.0,  # Outer diameter (OD)
    "ID": 35.0,
}
size = SIZE_CHOICE

if size == 1:
    params = params_middle
elif size == 2:
    params = params_large
else:
    params = params_small
# Global variables from chosen set
H_EXPANDED = params["H_EXPANDED"]
THETA = params["THETA"]
OD = params["OD"]
ID = params["ID"]
H_FOLDED = math.sin(math.radians(THETA) / 2) * OD * 1.1
print(H_FOLDED)

# ============================
# Geometry Functions
# ============================

def offset_plane(plane, d): # offset plane along normal by d
    new_plane = rg.Plane(plane)
    new_plane.Translate(plane.Normal * d)
    return new_plane

def create_translation_vector(plane): # rotated normal * length
    angle = -math.radians(THETA) / 2
    rot = rg.Transform.Rotation(angle, plane.YAxis, plane.Origin)
    vec = rg.Vector3d(plane.Normal); vec.Transform(rot); vec.Unitize()
    return vec * H_FOLDED 

def rotate_plane_byY(plane, deg): # rotate around Y-axis
    rad = math.radians(deg)
    rot = rg.Transform.Rotation(rad, plane.YAxis, plane.Origin)
    x = rg.Vector3d(plane.XAxis); y = rg.Vector3d(plane.YAxis)
    x.Transform(rot); y.Transform(rot)
    return rg.Plane(plane.Origin, x, y)

# ============================
# Command Transformations
# ============================

def function_e(plane): return offset_plane(plane, H_EXPANDED) # 'e' command

def function_f(plane): # 'f' command
    plane = rotate_plane_byY(plane, THETA)
    plane.Translate(create_translation_vector(plane))
    return plane

def function_r(plane, angle): # 'r' command
    rad = math.radians(angle)
    new_plane = plane.Clone()
    new_plane.Rotate(rad, new_plane.Normal, new_plane.Origin)
    return new_plane


def generate_planes(cmds, vals, start_plane):
    planes = [start_plane]
    for cmd, val in zip(cmds, vals):
        if cmd == 'r' and val != 0:
            planes[-1] = function_r(planes[-1], val)
        else:
            for _ in range(int(val)):
                planes.append(function_f(planes[-1]) if cmd == 'f' else function_e(planes[-1]))
    return planes



# ============================
# Visualization Helpers
# ============================

def create_circles1(planes, dia): # create circles on planes
    return [rg.Circle(p, dia / 2).ToNurbsCurve() for p in planes]

def create_circles(planes, diameter):
    curves = []
    for plane in planes:
        circle = rg.Circle(plane, diameter / 2.0)

        # Sample 8 points on the circle at even angles (fixed seam and structure)
        points = []
        for i in range(8):
            angle = math.radians(i * 45.0)
            x = math.cos(angle) * circle.Radius
            y = math.sin(angle) * circle.Radius
            pt = plane.PointAt(x, y)
            points.append(pt)

        points.append(points[0])  # Close the circle
        polycurve = rg.Curve.CreateInterpolatedCurve(points, 3, rg.CurveKnotStyle.Uniform)
        curves.append(polycurve)
    return curves


def create_circles_with_seam_tracking(planes, diameter):
    curves = []
    prev_tangent_point = None

    for i, plane in enumerate(planes):
        circle = rg.Circle(plane, diameter / 2.0)
        nurbs = circle.ToNurbsCurve()

        # Use initial seam aligned to first plane's XAxis
        if i == 0:
            seam_target = plane.Origin + plane.XAxis
        else:
            seam_target = prev_tangent_point

        success, t = nurbs.ClosestPoint(seam_target)
        if success:
            nurbs.ChangeClosedCurveSeam(t)

        # Store a point tangent to current circle XAxis for next seam alignment
        prev_tangent_point = plane.Origin + plane.XAxis

        curves.append(nurbs)

    return curves

def create_mid_planes2(planes): # average between planes
    mids = []
    for i in range(len(planes) - 1):
        p1, p2 = planes[i], planes[i + 1]
        mid_pt = (p1.Origin + p2.Origin) / 2
        x, y = p1.XAxis + p2.XAxis, p1.YAxis + p2.YAxis
        if x.Length == 0: print("Warning: X axes opposite", i); x = p2.XAxis
        if y.Length == 0: print("Warning: Y axes opposite", i); y = p2.YAxis
        x.Unitize(); y.Unitize()
        mids.append(rg.Plane(mid_pt, x, y) or offset_plane(p1, 1.5))
    return mids
    
def create_mid_planes(planes):
    mids = []
    for i in range(len(planes) - 1):
        p1, p2 = planes[i], planes[i + 1]
        mid_pt = (p1.Origin + p2.Origin) / 2

        x1, x2 = p1.XAxis, p2.XAxis
        y1, y2 = p1.YAxis, p2.YAxis

        # Flip if necessary to keep directions consistent
        if x1 * x2 < 0: x2 *= -1
        if y1 * y2 < 0: y2 *= -1

        mid_x = x1 + x2
        mid_y = y1 + y2
        mid_x.Unitize(); mid_y.Unitize()

        try:
            mids.append(rg.Plane(mid_pt, mid_x, mid_y))
        except:
            mids.append(offset_plane(p1, 1.5))
    return mids


# ============================
# Input Parsing
# ============================

def parseInput(x, y):
    x = x.replace("\n", "").replace("\r", "")
    y = y.replace("\n", "").replace("\r", "")
    if isinstance(x, str): x = x.split(',')
    if isinstance(y, str): y = [float(i) for i in y.split(',')]
    n = min(len(x), len(y))
    x, y = x[:n], y[:n]
    valid = n >= 2 and all(i in ('e', 'r', 'f') for i in x)
    return x, y

# ============================
# Main Execution
# ============================


cmd_arr, val_arr = parseInput(cmd, val)
first_plane = rg.Plane.WorldXY

if isinstance(origin, str): # override origin if provided
    origin = origin.replace("\n", "").replace("\r", "")
    x, y, z = [float(i) for i in origin.split(',')[:3]]
    pt = rg.Point3d(x, y, z)
    first_plane = rg.Plane(pt, rg.Vector3d(1, 0, 0), rg.Vector3d(0, 1, 0))

planes = generate_planes(cmd_arr, val_arr, first_plane)
mid_planes = create_mid_planes(planes)

debug_vectors = []
for p in planes:
    origin = p.Origin
    x_axis = p.XAxis
    line = rg.Line(origin, origin + x_axis * 5)
    debug_vectors.append(line)

#main_curves = create_circles(planes, D)
#mid_curves = create_circles(mid_planes, ID)

main_curves = create_circles_with_seam_tracking(planes, OD)
#mid_curves = create_circles_with_seam_tracking(mid_planes, ID)
mid_curves = create_circles(mid_planes, ID)

visualization_curves = [c for pair in zip(main_curves, mid_curves) for c in pair]
visualization_curves.append(main_curves[-1]) # add final curve

vis = visualization_curves # output for Grasshopper
# ---------- end cmd2vis_lll ----------
loft_5 = Loft(Curves=cmd2vis_lll.vis, Options={Adjust=False, Closed=False, LoftEnds=0, LoftSimp=0, LoftType=0, Rebuild=10, Refit=0.01})
cap_holes_ex_5 = CapHolesEx(Brep=loft_5)  # -> Brep, Caps, Solid

# ----
ghpython_script_4 = GhPythonScript()  # -> out, a
# ---------- ghpython_script_4: Python ----------
__author__ = "angelz"

import rhinoscriptsyntax as rs
import math

def divide_one_angle(n,max_fold=4):
    folds = []
    
    remainder = n
    cnt = math.ceil(n/max_fold)
        
    if cnt <= 1:
        folds.append(n)
        return folds
    if cnt > 2:
        remainder -= (cnt-2) * max_fold
        folds.extend([max_fold]*(cnt-2))
        
    if remainder == 5:
        folds.append(2)
        folds.append(3)
    elif remainder == 6:
        folds.append(3)
        folds.append(3)
    else:
        folds.append(max_fold)
        folds.append(remainder-max_fold)
        
    return folds
    

for i in range(1,9):
    print(i)
    arr = divide_one_angle(i)
    print(arr)
# ---------- end ghpython_script_4 ----------

# ---- group: 3D vis tube COPY
gh_3d_cmds_to_vis_2 = GhPythonScript(cmd="e,r,f,e,f,e,r,f,e,f,e,f", val="4, 0, 4.0, 1.0, 4.0, 19.0, -180.0, 1.0, 9.0, 3.0, 1.0, 2.0")  # -> out, vis
# ---------- gh_3d_cmds_to_vis_2: Python ----------
__author__ = "angelz"

import rhinoscriptsyntax as rs
import Rhino.Geometry as rg
import math
import json
import random



def FunctionE(plane):
    # print("function A called")
    r = offsetPlane(plane, 3.6)
    return r
    
def FunctionF(plane):
    # print("function A called")
    # r = offsetPlane(plane, 0.5)
    r = plane
    r = rotatePlane(r, 20)
    r = offsetPlane(r, 2.48)
    return r

def FunctionR(plane, angle):
    
    print(angle)
    angle = math.radians(angle)
    

    # Rotate the plane around its normal
    # The rotation axis is the plane's normal, and the rotation is performed about the plane's origin
    r = plane.Clone()  # Clone the original plane to keep it unchanged
    
    # print("raw")
    # print(r.XAxis,r.YAxis,r.ZAxis)
    
    x_old = r.XAxis
    y_old = r.YAxis
    
    axis = r.Normal
    
    r.Rotate(angle, axis, r.Origin)
    
    # print("rotated")
    # print(r.XAxis,r.YAxis,r.ZAxis)
    
    angle_x = calculate_rotation_angle(x_old, r.XAxis, plane.Normal)
    angle_y = calculate_rotation_angle(y_old, r.YAxis, plane.Normal)
    
    print(angle_x, angle_y)

    return r

def project_onto_plane(v, plane_normal):
    plane_normal.Unitize()  # Ensure the normal is a unit vector
    dot_product = rg.Vector3d.Multiply(v, plane_normal)
    projection = v - (dot_product * plane_normal)
    return projection
    
def calculate_rotation_angle(v1, v2, rotation_axis):
    
    v1 = project_onto_plane(v1, rotation_axis)
    v2 = project_onto_plane(v2, rotation_axis)
    
    # Calculate the angle between the original and rotated vectors
    dot_product = rg.Vector3d.Multiply(v1, v2)
    magnitude_product = v1.Length * v2.Length
    
    if abs(magnitude_product) >= 1:
        magnitude_product = magnitude_product / abs(magnitude_product)
    
    cos_num = dot_product / magnitude_product
    
    if abs(cos_num) > 1:
        print("cos",cos_num)
        cos_num = round(cos_num)
        
    angle_radians = math.acos(cos_num)
    
    
    # Convert radians to degrees
    angle_degrees = math.degrees(angle_radians)
    
    # Determine the direction of rotation
    cross_product = rg.Vector3d.CrossProduct(v1, v2)
    direction = rg.Vector3d.Multiply(cross_product, rotation_axis)
    
    # If the direction is negative, adjust the angle to reflect the opposite rotation
    if direction < 0:
        angle_degrees = -angle_degrees
    
    return round(angle_degrees)
    
def offsetPlane(plane, offset_distance):
            
    offset_plane = rg.Plane(plane)
    
    # Get the normal vector of the input plane
    
    translation_vector = plane.Normal

    offset_plane.Translate(translation_vector*3.6)
    
    return offset_plane
    
def rotatePlane(input_plane, angle_degrees):

    # Convert rotation angle to radians
    angle_radians = math.radians(angle_degrees)

    # Create a rotation transformation around the plane's origin
    rotation = rg.Transform.Rotation(angle_radians, input_plane.YAxis, input_plane.Origin)
    ###### To change direction, change the rotation axis
    
    rotated_y_axis = input_plane.YAxis
    rotated_y_axis.Transform(rotation)

    rotated_x_axis = input_plane.XAxis
    rotated_x_axis.Transform(rotation)
    
    rotated_plane = rg.Plane(input_plane.Origin, rotated_x_axis, rotated_y_axis)

    # Output the rotated plane
    return rotated_plane
    
def GeneratePlanes(cmd_arr, val_arr):
    planes = []
    planes.append(rg.Plane.WorldXY)
    
    tmp_plane = None
    
    for _, (cmd, val) in enumerate(zip(cmd_arr, val_arr)):
                
        if cmd == 'r' and val != 0:
            plane = planes[-1]
            plane = FunctionR(plane, val) # rotate the current plane by an angle
            planes[-1] = plane
        else: 
            for _ in range(int(val)):
                plane = planes[-1]
                new_plane = FunctionF(plane) if cmd == 'f' else FunctionE(plane) # e or f
                planes.append(new_plane)
    
    return planes

    
def createCircles(group, diameter):

    # Empty list to store circle surfaces
    curve_edges = []

    # Loop through each plane in the list
    for plane in group:
        # Create a circle at the plane's origin with the specified diameter
        circle = rg.Circle(plane, diameter / 2)
        
        # Convert the circle into a circle surface
        # circle_surface = rg.Surface.CreateExtrusion(circle.ToNurbsCurve(), plane.Normal * 0.1)  # Adjust the extrusion distance as needed
        
        # Append the circle surface to the list
        curve = circle.ToNurbsCurve()
        curve_edges.append(curve)

    # Output the list of circle surfaces
    return curve_edges
 
 
def createMidPlanes(planes):
    
    length = len(planes)
    mid_planes=[]
    
    for i in range(length-1):
 
        plane1 = planes[i]
        plane2 = planes[i+1]
        
        mid_point = (plane1.Origin + plane2.Origin) / 2

        # Interpolate the X, Y, and Z axes
        mid_x = (plane1.XAxis + plane2.XAxis) / 2
        
        if mid_x.Length == 0:
            print(i)
            print("planes x are opposite 180 deg")
            mid_x = plane2.XAxis
            
        mid_y = (plane1.YAxis + plane2.YAxis) / 2
        
        if mid_y.Length == 0:
            print(i)
            mid_y = plane2.YAxis
            print("planes y are opposite 180 deg")
        

        # Normalize the axes
        mid_x.Unitize()
        mid_y.Unitize()

        # Create the mid-plane
        mid_plane = rg.Plane(mid_point, mid_x, mid_y)
        if mid_plane == None:
            mid_plane = offset_plane(plane1, 1.5)
        mid_planes.append(mid_plane)

    return mid_planes

def parseInput(x, y):
    # Parse command sequence
    x = x.replace("\n", "").replace("\r", "")
    y = y.replace("\n", "").replace("\r", "")

    if isinstance(x, str):
        x = [i for i in x.split(',')]
    # Ensure the sequence list contains only 0s and 1s
        # Parse value sequence
    if isinstance(y, str):
        y = [float(i) for i in y.split(',')]
        
    # Trim array
    trim_len = min(len(x), len(y))
    x = x[:trim_len]
    y = y[:trim_len]

    # Check if sequences are valid
    valid_sequence = (trim_len >= 2)
    valid_sequence &= all(i == 'e' or i=='r' or i == 'f' for i in x)
    # valid_sequence &= all(i >= 0 for i in y)
    
    if valid_sequence:
        print("Valid Input")
        print(x)
        print(y)
    else:
        # Handle invalid input
        print("Invalid input.")
        print("Please provide'e','r','f' for commands.")
        print("Please provide nonnegative count or angle for value")
        print("Generating random values for testing...")
        # x,y = genRandom(x,y)
        
        print((x,y))
        
    return (x,y)

def get_random_char(ex=None):
    characters = ['e', 'r', 'f']
    if ex:
        characters.remove(ex)
    return random.choice(characters)
    
def genRandom():
    x = []
    y = []
    repeat = 0
    prev = ''
    i = 0
    while i < 50:
        
        tmp = get_random_char(ex=prev)
        
        x.append(tmp)
        
        if tmp == 'r':
            y.append(random.randint(-180,180))
        elif tmp == 'e':
            step = random.randint(1,6)
            y.append(step)
            i += step
        else:
            step = random.randint(1,3)
            y.append(step)
            i += step
        prev = tmp
        

    return (x,y)


# cmd_arr, val_arr = genRandom()

cmd_arr, val_arr = parseInput(cmd,val)



planes = GeneratePlanes(cmd_arr, val_arr)

# Create a Group to store all the planes

midplanes= createMidPlanes(planes)
 
    
# Output the resulting group of planes
main = createCircles(planes,11) # original 11
mid = createCircles(midplanes, 8)

a = [val for pair in zip(main, mid) for val in pair]
a.append(main[-1])

vis = a
# ---------- end gh_3d_cmds_to_vis_2 ----------
cluster_2 = Cluster()
loft_6 = Loft(Curves=gh_3d_cmds_to_vis_2.vis, Options=cluster_2)
cap_holes_ex_6 = CapHolesEx(Brep=loft_6)  # -> Brep, Caps, Solid

# ---- group: 3D Polyline To Commands & Visualization
folder_path_for_commands_2 = Panel("/Users/angelz/Desktop")
tube_len_sections_5 = Panel("350")

# ----
gh_3d_poly_to_commands = GhPythonScript(x=curve_to_polyline.Polyline, tube_len=tube_len_sections_5, max_fold=number_slider_2)  # -> out, x, y, a, b, c, d, e
# ---------- gh_3d_poly_to_commands: Python ----------
__author__ = "angelz"

import rhinoscriptsyntax as rs
import Rhino.Geometry as rg
import math

def rotate_polyline_to_align_with_z(polyline):
    rotation_axis = rg.Vector3d.CrossProduct(polyline.SegmentAt(0).Direction, rg.Vector3d.ZAxis)
    if not rotation_axis.IsZero:
        return polyline
    angle = rg.Vector3d.VectorAngle(polyline.SegmentAt(0).Direction, rg.Vector3d.ZAxis)
    rotation = rg.Transform.Rotation(angle, rotation_axis, polyline[0])
    rotated_polyline = polyline.Duplicate()
    rotated_polyline.Transform(rotation)
    return rotated_polyline

def rotate_vector_to_angle(v2, v1, alpha_degrees):
    rotation_axis = rg.Vector3d.CrossProduct(v1, v2)
    rotation_axis.Unitize()
    rotated_v2 = v1.Clone()
    alpha_radians = math.radians(alpha_degrees)
    rotation_success = rotated_v2.Rotate(alpha_radians, rotation_axis)
    return rotated_v2 if rotation_success else None

def rotate_vector_around_axis(vector_to_rotate, axis_point, axis_direction, angle_degrees):
    if not axis_direction.IsUnitVector:
        axis_direction.Unitize()
    angle_radians = math.radians(angle_degrees)
    rotation = rg.Transform.Rotation(angle_radians, axis_direction, axis_point)
    rotated_vector = vector_to_rotate.Clone()
    rotated_vector.Transform(rotation)
    return rotated_vector

def project_onto_plane(v, plane_normal):
    plane_normal.Unitize()
    dot_product = rg.Vector3d.Multiply(v, plane_normal)
    projection = v - (dot_product * plane_normal)
    return projection

def project_onto_axis(v, axis):
    axis.Unitize()  # Ensure the axis is a unit vector
    dot_product = rg.Vector3d.Multiply(v, axis)
    projection = dot_product * axis
    return projection
    

def calculate_rotation_angle(original_vec, rotated_vec, rotation_axis):
    original_vec, rotated_vec = [project_onto_plane(v, rotation_axis) for v in [original_vec, rotated_vec]]
    if not original_vec.Length or not rotated_vec.Length: return 0
    angle = rg.Vector3d.VectorAngle(original_vec, rotated_vec)
    angle = round(math.degrees(angle))
    if rg.Vector3d.CrossProduct(original_vec, rotated_vec) * rotation_axis < 0: angle = -angle
    return angle

def deconstruct_poly(p):
    r_angles = [0]
    f_angles = [0]
    lengths = [p.SegmentAt(0).Length]
    for i in range(p.SegmentCount-1):
        vi = p.SegmentAt(i).Direction
        vn = p.SegmentAt(i+1).Direction 
        projp = project_onto_plane(-p.SegmentAt(i-1).Direction, vi) if i else rg.Vector3d.XAxis
        projn = project_onto_plane(vn,vi)
        f = round(math.degrees(rg.Vector3d.VectorAngle(vi, vn)))
        r = calculate_rotation_angle(projp,projn,vi) if f else 0
        r_angles.append(r)
        f_angles.append(f)
        lengths.append(vn.Length)
    return lengths, r_angles, f_angles
    
def construct_poly(lengths,r_angles,f_angles, origin = rg.Point3d(-50,0,0)):
    points = [origin]
    fold_vector = rg.Vector3d.XAxis
    vectors = [rg.Vector3d.ZAxis]
    
    for i,(l,r,f) in enumerate(zip(lengths,r_angles,f_angles)):
        pt = points[-1]
        vp = vectors[-1]
        vc = vp
        
        if f: vc = rotate_vector_to_angle(fold_vector,vp,f)
        if f and r: vc = rotate_vector_around_axis(vc, pt, vp, r)
        vc.Unitize()
        np = pt + vc * l
        
        points.append(np)
        vectors.append(vc)
        
        if i > 0 and f: fold_vector = project_onto_plane(-vp,vc)
            
    polyline = rg.Polyline(points)
            
    return polyline

def get_abs_cos(deg):
    return abs(math.cos(math.radians(deg)))
    

def divide_angles(lengths, r_angles, f_angles, constraint=0,max_fold=3):

    ls, rs, fs = [], [], []
    for i, (l, r, f) in enumerate(zip(lengths, r_angles, f_angles)):
        nf = f_angles[i + 1] if i + 1 < len(lengths) else 0
        if f > 0:
            num = int(round(f / 20)) 
            dir_flag = f/abs(f)
            rs.append(r)
            l -= sum(2.48 * get_abs_cos(20 * i) for i in range(num))
            
            
            if constraint != 0 and num > max_fold:
                while num > max_fold:
                    rs.extend([0] * max_fold)
                    ls.extend([2.48] * max_fold)
                    fs.extend([20*dir_flag] * max_fold)
                    rs.append(0)
                    ls.append(3.6)
                    fs.append(0)
                    l -= sum(2.48 * 1 / get_abs_cos(20 * i) for i in range(max_fold))
                    #l -= 3.6*max_fold
                    num -= max_fold
                    
            rs.extend([0] * (num - 1))
            ls.extend([2.48] * num)
            fs.extend([20*dir_flag] * num)
            
        if nf > 0:
            num = int(round(nf / 20))
            num = int(round(num / 2))
            l -= sum(2.48 * 1 / get_abs_cos(20 * i) for i in range(num))
            # l -= 3.6*num
            
        l = max(l, 3.6)
        rs.append(0)
        ls.append(l)
        fs.append(0)

    return ls, rs, fs


def poly2commands(lengths, r_angles, f_angles,max_fold=4):
    # convert to degrees
    cmds = []
    vals = []
    cos20 = math.cos(math.radians(20))
    
    for i,(l,r,f) in enumerate(zip(lengths,r_angles,f_angles)):
        
        nf = f_angles[i+1] if i+1 < len(lengths) else 0
        
        if nf > 0:
            num = int(round(nf/20/2))
            # l -= num*2.48*cos20
            #l -= math.ceil(num/2)*3.6
            # l -= 3.6
            l -= sum(2.48 * 1 / get_abs_cos(20 * i) for i in range(num))
                        
        if f > 0:
            
            num = int(round(f / 20)) 
            # l -= num*2.48*cos20
            l -= math.floor(num/2)*3.6
            # l -= num * 3.6
            l -= 3.6
            
                                    
            cmds.append('r')
            vals.append(r)
            
            for _ in range(int(math.ceil(num/max_fold))):
                
                if num <= max_fold:
            
                    cmds.append('f')
                    vals.append(num)
                else:
                    cmds.append('f')
                    vals.append(max_fold)
                    cmds.append('e')
                    vals.append(1)
                    l -= sum(2.48 * 1 / get_abs_cos(20 * i) for i in range(max_fold))
                    num -= max_fold
            
        cnt = int(max(round(l/3.6),1))
        
        cmds.append('e')
        vals.append(cnt)

    return cmds,vals
    

def scale_polyline_to_length(polyline, target_length):
    current_length = sum(polyline.SegmentAt(i).Length for i in range(polyline.SegmentCount))
    scale_factor = target_length / current_length
    scaled_polyline = polyline.Duplicate()
    scaled_polyline.Transform(rg.Transform.Scale(polyline[0], scale_factor))
    return scaled_polyline
    

def combine_collinear_segments(polyline):
    new_points = [polyline[0]]
    for i in range(1, len(polyline) - 1):
        p0, p1, p2 = polyline[i-1], polyline[i], polyline[i+1]
        v1, v2 = p1 - p0, p2 - p1
        v1.Unitize()
        v2.Unitize()
        if math.fabs(v1 * v2) < 0.999:
            new_points.append(p1)
    new_points.append(polyline[len(polyline)-1])
    return rg.Polyline(new_points)

def add_z_segment_before(polyline, length=3.6):
    new_polyline = rg.Polyline(polyline)
    first_point = new_polyline[0]
    new_point = rg.Point3d(first_point.X, first_point.Y, first_point.Z - length)
    new_polyline.Insert(0, new_point)
    new_polyline.Transform(rg.Transform.Translation(rg.Vector3d(0, 0, length)))
    return new_polyline

    
pl = rs.coercecurve(x).ToPolyline()
if isinstance(tube_len, str):
    tube_len = int(tube_len) * 3.6
polyline = scale_polyline_to_length(pl, target_length=tube_len)
polyline = add_z_segment_before(polyline)
polyline = combine_collinear_segments(polyline)


# get lengths, rotation angles, and folding angles 
lengths, r_angles, f_angles = deconstruct_poly(polyline)

pt = construct_poly(lengths, r_angles, f_angles,rg.Point3d(0,0,0))

if max_fold:
    print("get max fold input")
    max_fold = int(round(max_fold))
    print(max_fold)
    new_ls,new_rs,new_fs  = divide_angles(lengths, r_angles, f_angles,1,max_fold)
    commands, values = poly2commands(lengths, r_angles, f_angles,max_fold)

else:
    new_ls,new_rs,new_fs  = divide_angles(lengths, r_angles, f_angles,1)
    commands, values = poly2commands(lengths, r_angles, f_angles)



pt3 = construct_poly(new_ls,new_rs,new_fs,rg.Point3d(0,0,0))

commands, values = poly2commands(lengths, r_angles, f_angles,max_fold)

x = (',').join(commands)
y = (',').join(map(str,values))

print(x)
print(y)

print(len(pl))
print(len(polyline))
print(len(pt))
a = []
b = pt

# c = pt2
d = pt3
# ---------- end gh_3d_poly_to_commands ----------

# ---- group: 3D Polyline To Commands & Visualization / 3D POLYLINE to VIS CMDS
_4_fold_3d2tube = GhPythonScript(x=curve_4, tube_len=tube_len_sections_5, max_fold=number_slider_2)  # -> out, x, y, a, b, c, d, e
# ---------- _4_fold_3d2tube: Python ----------
__author__ = "angelz"

'''
# only support fold 4
'''

import rhinoscriptsyntax as rs
import Rhino.Geometry as rg
import math

def rotate_polyline_to_align_with_z(polyline):
    rotation_axis = rg.Vector3d.CrossProduct(polyline.SegmentAt(0).Direction, rg.Vector3d.ZAxis)
    if not rotation_axis.IsZero:
        return polyline
    angle = rg.Vector3d.VectorAngle(polyline.SegmentAt(0).Direction, rg.Vector3d.ZAxis)
    rotation = rg.Transform.Rotation(angle, rotation_axis, polyline[0])
    rotated_polyline = polyline.Duplicate()
    rotated_polyline.Transform(rotation)
    return rotated_polyline

def rotate_vector_to_angle(v2, v1, alpha_degrees):
    rotation_axis = rg.Vector3d.CrossProduct(v1, v2)
    rotation_axis.Unitize()
    rotated_v2 = v1.Clone()
    alpha_radians = math.radians(alpha_degrees)
    rotation_success = rotated_v2.Rotate(alpha_radians, rotation_axis)
    return rotated_v2 if rotation_success else None

def rotate_vector_around_axis(vector_to_rotate, axis_point, axis_direction, angle_degrees):
    if not axis_direction.IsUnitVector:
        axis_direction.Unitize()
    angle_radians = math.radians(angle_degrees)
    rotation = rg.Transform.Rotation(angle_radians, axis_direction, axis_point)
    rotated_vector = vector_to_rotate.Clone()
    rotated_vector.Transform(rotation)
    return rotated_vector

def project_onto_plane(v, plane_normal):
    plane_normal.Unitize()
    dot_product = rg.Vector3d.Multiply(v, plane_normal)
    projection = v - (dot_product * plane_normal)
    return projection

def project_onto_axis(v, axis):
    axis.Unitize()  # Ensure the axis is a unit vector
    dot_product = rg.Vector3d.Multiply(v, axis)
    projection = dot_product * axis
    return projection
    

def calculate_rotation_angle(original_vec, rotated_vec, rotation_axis):
    original_vec, rotated_vec = [project_onto_plane(v, rotation_axis) for v in [original_vec, rotated_vec]]
    if not original_vec.Length or not rotated_vec.Length: return 0
    angle = rg.Vector3d.VectorAngle(original_vec, rotated_vec)
    angle = round(math.degrees(angle))
    if rg.Vector3d.CrossProduct(original_vec, rotated_vec) * rotation_axis < 0: angle = -angle
    return angle

def deconstruct_poly(p):
    r_angles = [0]
    f_angles = [0]
    lengths = [p.SegmentAt(0).Length]
    for i in range(p.SegmentCount-1):
        vi = p.SegmentAt(i).Direction
        vn = p.SegmentAt(i+1).Direction 
        projp = project_onto_plane(-p.SegmentAt(i-1).Direction, vi) if i else rg.Vector3d.XAxis
        projn = project_onto_plane(vn,vi)
        f = round(math.degrees(rg.Vector3d.VectorAngle(vi, vn)))
        r = calculate_rotation_angle(projp,projn,vi) if f else 0
        r_angles.append(r)
        f_angles.append(f)
        lengths.append(vn.Length)
    return lengths, r_angles, f_angles
    
def construct_poly(lengths,r_angles,f_angles, origin = rg.Point3d(-50,0,0)):
    points = [origin]
    fold_vector = rg.Vector3d.XAxis
    vectors = [rg.Vector3d.ZAxis]
    
    for i,(l,r,f) in enumerate(zip(lengths,r_angles,f_angles)):
        pt = points[-1]
        vp = vectors[-1]
        vc = vp
        
        if f: vc = rotate_vector_to_angle(fold_vector,vp,f)
        if f and r: vc = rotate_vector_around_axis(vc, pt, vp, r)
        vc.Unitize()
        np = pt + vc * l
        
        points.append(np)
        vectors.append(vc)
        
        if i > 0 and f: fold_vector = project_onto_plane(-vp,vc)
            
    polyline = rg.Polyline(points)
            
    return polyline

def get_abs_cos(deg):
    return abs(math.cos(math.radians(deg)))
    

def divide_angles(lengths, r_angles, f_angles, constraint=0,max_fold=3):

    ls, rs, fs = [], [], []
    for i, (l, r, f) in enumerate(zip(lengths, r_angles, f_angles)):
        nf = f_angles[i + 1] if i + 1 < len(lengths) else 0
        if f > 0:
            num = int(round(f / 20)) 
            dir_flag = f/abs(f)
            rs.append(r)
            l -= sum(2.48 * get_abs_cos(20 * i) for i in range(num))
            
            
            if constraint != 0 and num > max_fold:
                while num > max_fold:
                    rs.extend([0] * max_fold)
                    ls.extend([2.48] * max_fold)
                    fs.extend([20*dir_flag] * max_fold)
                    rs.append(0)
                    ls.append(3.6)
                    fs.append(0)
                    l -= sum(2.48 * 1 / get_abs_cos(20 * i) for i in range(max_fold))
                    #l -= 3.6*max_fold
                    num -= max_fold
                    
            rs.extend([0] * (num - 1))
            ls.extend([2.48] * num)
            fs.extend([20*dir_flag] * num)
            
        if nf > 0:
            num = int(round(nf / 20))
            num = int(round(num / 2))
            l -= sum(2.48 * 1 / get_abs_cos(20 * i) for i in range(num))
            # l -= 3.6*num
            
        l = max(l, 3.6)
        rs.append(0)
        ls.append(l)
        fs.append(0)

    return ls, rs, fs


def poly2commands(lengths, r_angles, f_angles,max_fold=4):
    # convert to degrees
    cmds = []
    vals = []
    cos20 = math.cos(math.radians(20))
    
    max_fold = 4
    
    for i,(l,r,f) in enumerate(zip(lengths,r_angles,f_angles)):
        
        nf = f_angles[i+1] if i+1 < len(lengths) else 0
        
        if nf > 0:
            num = int(round(nf/20/2))
            # l -= num*2.48*cos20
            #l -= math.ceil(num/2)*3.6
            # l -= 3.6
            l -= sum(2.48 * 1 / get_abs_cos(20 * i) for i in range(num))
                        
        if f > 0:
            
            num = int(round(f / 20)) 
            # l -= num*2.48*cos20
            l -= math.floor(num/2)*3.6
            # l -= num * 3.6
            l -= 3.6
            
                                    
            cmds.append('r')
            vals.append(r)
            
            if num <= 4:
                cmds.append('f')
                vals.append(num)
            elif num <= 6:
                cmds+=['f','e','f']
                vals+=[3,1,num-3]
            else:
                num = 8 if num > 8 else num
                cmds+=['f','e','f']
                vals+=[4,1,num-4]
                
            l -= sum(2.48 * 1 / get_abs_cos(20 * i) for i in range(num-4))
            
        cnt = int(max(round(l/3.6),1))
        
        cmds.append('e')
        vals.append(cnt)

    return cmds,vals
    

def scale_polyline_to_length(polyline, target_length):
    current_length = sum(polyline.SegmentAt(i).Length for i in range(polyline.SegmentCount))
    scale_factor = target_length / current_length
    scaled_polyline = polyline.Duplicate()
    scaled_polyline.Transform(rg.Transform.Scale(polyline[0], scale_factor))
    return scaled_polyline
    

def combine_collinear_segments(polyline):
    new_points = [polyline[0]]
    for i in range(1, len(polyline) - 1):
        p0, p1, p2 = polyline[i-1], polyline[i], polyline[i+1]
        v1, v2 = p1 - p0, p2 - p1
        v1.Unitize()
        v2.Unitize()
        if math.fabs(v1 * v2) < 0.999:
            new_points.append(p1)
    new_points.append(polyline[len(polyline)-1])
    return rg.Polyline(new_points)

def add_z_segment_before(polyline, length=3.6):
    new_polyline = rg.Polyline(polyline)
    first_point = new_polyline[0]
    new_point = rg.Point3d(first_point.X, first_point.Y, first_point.Z - length)
    new_polyline.Insert(0, new_point)
    new_polyline.Transform(rg.Transform.Translation(rg.Vector3d(0, 0, length)))
    return new_polyline

    
pl = rs.coercecurve(x).ToPolyline()
if isinstance(tube_len, str):
    tube_len = int(tube_len) * 3.6
polyline = scale_polyline_to_length(pl, target_length=tube_len)
polyline = add_z_segment_before(polyline)
polyline = combine_collinear_segments(polyline)


# get lengths, rotation angles, and folding angles 
lengths, r_angles, f_angles = deconstruct_poly(polyline)

pt = construct_poly(lengths, r_angles, f_angles,rg.Point3d(0,0,0))

if max_fold:
    print("get max fold input")
    max_fold = int(round(max_fold))
    print(max_fold)
    new_ls,new_rs,new_fs  = divide_angles(lengths, r_angles, f_angles,1,max_fold)
    commands, values = poly2commands(lengths, r_angles, f_angles,max_fold)

else:
    new_ls,new_rs,new_fs  = divide_angles(lengths, r_angles, f_angles,1)
    commands, values = poly2commands(lengths, r_angles, f_angles)



pt3 = construct_poly(new_ls,new_rs,new_fs,rg.Point3d(0,0,0))

commands, values = poly2commands(lengths, r_angles, f_angles,max_fold)

x = (',').join(commands)
y = (',').join(map(str,values))

print(zip(commands,values))

a = []
b = pt

# c = pt2
d = pt3
# ---------- end _4_fold_3d2tube ----------
panel_15 = Panel(_4_fold_3d2tube.x)
panel_16 = Panel(_4_fold_3d2tube.y)

# ---- group: 3D Polyline To Commands & Visualization / 3D vis polyline
polyline_11 = PolyLine(Vertices=_4_fold_3d2tube.a, Closed=False)
polyline_12 = PolyLine(Vertices=_4_fold_3d2tube.b, Closed=False)

# ---- group: 3D Polyline To Commands & Visualization (continued)
polyline_13 = PolyLine(Vertices=_4_fold_3d2tube.c, Closed=False)
polyline_14 = PolyLine(Vertices=_4_fold_3d2tube.d, Closed=False)
panel_17 = Panel(_4_fold_3d2tube.out)

# ---- group: 3D Polyline To Commands & Visualization / VIS CMDS TO MOTOR CMDS & FILE
ghpython_script_5 = GhPythonScript(cmds=panel_15, vals=panel_16, filepath_input=folder_path_for_commands_2)  # -> out, a, b
# ---------- ghpython_script_5: Python ----------
__author__ = "angelz"

import rhinoscriptsyntax as rs
import json


def parseInput(x, y):
    x = x.replace("\n\r", "").split(',')
    y = [float(i) for i in y.replace("\n\r", "").split(',')]
    min_len = min(len(x), len(y))
    x, y = x[:min_len], y[:min_len]
    if min_len >= 3 and all(cmd in ['e', 'r', 'f'] for cmd in x):
        print("Valid Input")
    else:
        print("Invalid input. Please provide 'e', 'r', 'f' for commands and nonnegative values.")
    return x, y

def convert2motorCmds(cmds, vals):
    if cmds[0] == 'e' and vals[0] == 1:
        cmds = cmds[1:]
        vals = vals[1:]
        
    if cmds[0] == 'f':
        cmds = cmds[1:]
        vals = vals[1:]
    elif cmds[0] == 'r' and cmds[1] == 'f':
        if cmds[2] == 'e' and vals[2] == 1 and cmds[3] == 'f':
            print("removed large angle")
            idx_r = cmds[1:].index('r')
            print(idx_r)
            cmds = cmds[idx_r:]
            vals = vals[idx_r:]
        else:
            print("removed small angle")
            cmds = cmds[2:]
            vals = vals[2:]

    print(zip(cmds,vals))
    
    first_r = 0
    
    ncmds = []
    nvals = []
    vcmds = []
    vvals = []
    
    for c, v in zip(cmds, vals):
        if not first_r and c == 'r':
            first_r = 1
            continue
        new_v = v
        if abs(new_v) > 180:
            dir_flag = new_v/abs(new_v)
            new_v = dir_flag * (360 - abs(new_v))
        if c == 'r' and v == 0:
            continue
        elif c == 'r':
            new_v = -v if v != 0 else v #-180 to 180 
            if new_v > 0:
                nvals.append(-180)
                ncmds.append('r')
                new_v = -new_v
            
            
        ncmds.append(c)
        nvals.append(new_v)
        vcmds.append(c)
        vvals.append(v)

    return ncmds, nvals,vcmds,vvals


cmd_arr,val_arr = parseInput(cmds,vals)

print(zip(cmd_arr,val_arr))

cmd_arr,val_arr, vcmds, vvals = convert2motorCmds(cmd_arr,val_arr)

a = ','.join(vcmds)
b = ','.join(map(str,vvals))

a = ','.join(cmd_arr)
b = ','.join(map(str,val_arr))

print('\n')
print(zip(cmd_arr,val_arr))

#print(zip(vcmds,vvals))

# Prepare data and define file path
tmp = {"values": val_arr, "commands": cmd_arr}
folder_path = filepath_input if filepath_input else '/Users/angelz/Desktop/'
json_path = "{}/gh_commands.json".format(folder_path.rstrip('/'))

# Save data to JSON file
with open(json_path, 'w') as json_file:
    json.dump(tmp, json_file, indent=4)

print("Data saved to JSON file: {}".format(json_path))
# ---------- end ghpython_script_5 ----------
panel_18 = Panel(ghpython_script_5.out)

# ----
panel_19 = Panel(ghpython_script_5.b)
panel_20 = Panel(ghpython_script_5.a)

# ---- group: 3D vis tube COPY
gh_3d_cmds_to_vis_3 = GhPythonScript(cmd=panel_20, val=panel_19)  # -> out, vis; same code as gh_3d_cmds_to_vis_2
cluster_3 = Cluster()
loft_7 = Loft(Curves=gh_3d_cmds_to_vis_3.vis, Options=cluster_3)
cap_holes_ex_7 = CapHolesEx(Brep=loft_7)  # -> Brep, Caps, Solid; disabled

# ==== cluster Cluster
number_slider = Slider(0, range=0..100)
number_slider_2 = Slider(0, range=0..1)
loft_options = LoftOptions(Closed=number_slider_2, Adjust=number_slider_2, Rebuild=number_slider, Refit=number_slider, Type=Slider(2, range=0..10))
options = ClusterOutput(loft_options)
